# Grasshopper definition aria-facade-definition.gh (Grasshopper 1.0.8)
# plug-ins: LunchBox

crv = Curve(<curve referenced from the Rhino model>)
crv_2 = Curve(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)
surface = Surface(crv_2)
surface_2 = Surface(crv)
bounding_box = BoundingBox(Content=surface, Plane=PlaneXY(0, 0, 0), UnionBox=True)  # -> Box, Box_2
surface_3 = Surface(bounding_box.Box)
curve = Curve(surface_3)

number_slider = Slider(5, range=0..10)
division = Division(A=Slider(200, range=0..200), B=number_slider)
division_2 = Division(A=Slider(200, range=0..200), B=number_slider)
triangular = Triangular(Plane=PlaneXY(0, 0, 0), Size=number_slider, ExtentX=division_2, ExtentY=division)  # -> Cells, Points

discontinuity = Discontinuity(Curve=curve, Level=1)  # -> Points, Parameters
list_item = ListItem(List=discontinuity.Points, Index=0, Wrap=True)  # -> Item, Item1, Item2, Item3
point = Point(list_item.Item1)
cell_scale_start = Number(Slider(0.1, range=0..1))
cell_scale_end = Number(Slider(0.8, range=0..1))

negative = Negative(Value=Slider(0.208, range=0..1))
offset_curve = OffsetCurve(Curve=triangular.Cells, Distance=negative, Corners=1)

cell_scale = Number(Slider(1, range=0..1))
distance = Distance(PointA=list_item.Item, PointB=list_item.Item3)
distance_2 = Distance(PointA=list_item.Item, PointB=list_item.Item1)
line = Line(StartPoint=list_item.Item, EndPoint=list_item.Item1)

diamond_grid = DiamondGrid(Surface=surface_2, UDivisions=Slider(60, range=0..100), VDivisions=Slider(100, range=0..100))  # -> CornerPoint1, CornerPoint2, CornerPoint3, CornerPoint4, MidPoint, Normals
line_2 = Line(StartPoint=diamond_grid.CornerPoint2, EndPoint=diamond_grid.CornerPoint3)
line_3 = Line(StartPoint=diamond_grid.CornerPoint1, EndPoint=diamond_grid.CornerPoint2)
curve_2 = Curve([line_3, line_2])
join_curves = JoinCurves(Curves=curve_2, Preserve=False)
surface_split = SurfaceSplit(Surface=surface_2, Curves=flatten(join_curves))

area = Area(Geometry=surface_2)  # -> Area, Centroid
number_slider_2 = Slider(20, range=0..50)
division_3 = Division(A=distance_2, B=number_slider_2)
division_4 = Division(A=distance, B=number_slider_2)
number_slider_3 = Slider(1.35, range=0..10)
round = Round(Number=division_3)  # -> Nearest, Floor, Ceiling
round_2 = Round(Number=division_4)  # -> Nearest, Floor, Ceiling
panel = Panel("C:\Users\fharker\Downloads\luke-bender-uVcjUFOy-Gk-unsplash.jpg")
point_2 = Point(Point(1.564889617, 1.251215062, 0))
number_slider_4 = Slider(20, range=0..200)  # disabled
number_slider_5 = Slider(5, range=0..10)  # disabled
number_slider_6 = Slider(20, range=0..200)  # disabled
division_5 = Division(A=round.Floor, B=number_slider_3)
division_6 = Division(A=round_2.Floor, B=number_slider_3)
curve_3 = Curve(offset_curve)
round_3 = Round(Number=division_5)  # -> Nearest, Floor, Ceiling
round_4 = Round(Number=division_6)  # -> Nearest, Floor, Ceiling

# ---- group: SECONDARY SCALE
number_slider_7 = Slider(0.668, range=0..1)

# ---- group: PRIMARY SCALE
number_slider_8 = Slider(0.356, range=0..1)

# ----
division_7 = Division(A=number_slider_4, B=number_slider_5)  # disabled
division_8 = Division(A=number_slider_6, B=number_slider_5)  # disabled
geometry = Geometry(surface_split)
panel_2 = Panel("""Clamp
Repeat
Mirror""")
cell_scale_start_2 = Number(Slider(0.1, range=0..1))
cell_scale_end_2 = Number(Slider(0.8, range=0..1))
number_slider_9 = Slider(0.208, range=0..1)  # disabled
cell_scale_2 = Number(Slider(1, range=0..1))
area_2 = Area(Geometry=geometry)  # -> Area, Centroid
panel_3 = Panel("C:\Users\fharker\Downloads\luke-bender-uVcjUFOy-Gk-unsplash.jpg")
hexagonal = Hexagonal(Plane=PlaneXY(0, 0, 0), Size=number_slider_5, ExtentX=number_slider_4, ExtentY=number_slider_6)  # -> Cells, Points; disabled
point_3 = Point(Point(1.564889617, 1.251215062, 0))  # disabled
surface_4 = Surface(crv)
area_3 = Area(Geometry=curve_3)  # -> Area, Centroid
item = ListItem(List=panel_2, Index=Slider(0, range=0..10), Wrap=True)

bbox = BoundingBox(Content=flatten(geometry), Plane=area.Centroid, UnionBox=True)  # -> Box, Box_2
debrep = DeconstructBrep(Brep=bbox.Box)  # -> flatten(Faces), Edges, Vertices
pt = Point(area_2.Centroid)
srf_cp = SurfaceClosestPoint(Point=pt, Surface=reparameterize(debrep.Faces))  # -> Point, UVPoint, Distance
image_sampler = GhPythonScript(Path=panel, UV=flatten(srf_cp.UVPoint), Mode=item, FlipV=Slider(1, range=0..1))  # -> C, G, Size, Report; inputs UV: list of Point3d, FlipV: Boolean
# ---------- image_sampler: Python ----------
"""Image Sampler via File Path (UV in 0..1)
Author: FHarker + ChatGPT (2025.10)
"""

import System
import os, math
import scriptcontext  # ✅ must be imported first
from System.Drawing import Bitmap, Color
from Rhino.Geometry import Point2d

# ---------- helpers ----------
def _mirror_wrap(t):
    ti = math.floor(t)
    frac = t - ti
    if int(ti) % 2 != 0:
        frac = 1.0 - frac
    return frac

def wrap01(x, mode):
    if mode == 0:  # Clamp
        return max(0.0, min(1.0, x))
    elif mode == 1:  # Repeat
        return x - math.floor(x)
    else:  # Mirror
        return _mirror_wrap(x)

def bilinear_sample(bmp, x, y):
    """x,y in pixel space (float). Returns Color via bilinear filtering."""
    w, h = bmp.Width, bmp.Height
    x = max(0.0, min(w - 1.0, x))
    y = max(0.0, min(h - 1.0, y))

    x0 = int(math.floor(x))
    y0 = int(math.floor(y))
    x1 = min(x0 + 1, w - 1)
    y1 = min(y0 + 1, h - 1)

    fx = x - x0
    fy = y - y0

    c00 = bmp.GetPixel(x0, y0)
    c10 = bmp.GetPixel(x1, y0)
    c01 = bmp.GetPixel(x0, y1)
    c11 = bmp.GetPixel(x1, y1)

    def lerp(a, b, t): return a + (b - a) * t

    a0 = lerp(c00.A, c10.A, fx); a1 = lerp(c01.A, c11.A, fx); a = int(lerp(a0, a1, fy))
    r0 = lerp(c00.R, c10.R, fx); r1 = lerp(c01.R, c11.R, fx); r = int(lerp(r0, r1, fy))
    g0 = lerp(c00.G, c10.G, fx); g1 = lerp(c01.G, c11.G, fx); g = int(lerp(g0, g1, fy))
    b0 = lerp(c00.B, c10.B, fx); b1 = lerp(c01.B, c11.B, fx); b = int(lerp(b0, b1, fy))

    return Color.FromArgb(a, r, g, b)

def to_gray01(col):
    return (0.2126*col.R + 0.7152*col.G + 0.0722*col.B) / 255.0

def as_uv2(pt):
    return float(pt.X), float(pt.Y)

# ---------- sticky cache ----------
key = "img_cache_v1"
cache = scriptcontext.sticky.get(key, {})

def get_bitmap(path):
    if not path or not os.path.isfile(path):
        return None, "No file at path."
    try:
        mtime = os.path.getmtime(path)
    except:
        mtime = None
    entry = cache.get(path)
    if entry and entry.get("mtime") == mtime:
        return entry["bmp"], "Cached"
    try:
        bmp = Bitmap(path)
        cache[path] = {"bmp": bmp, "mtime": mtime}
        scriptcontext.sticky[key] = cache
        return bmp, "Loaded"
    except Exception as e:
        return None, "Load error: %s" % e

# ---------- main ----------
mode_map = {"clamp": 0, "repeat": 1, "mirror": 2}
m = mode_map.get((Mode or "Clamp").strip().lower(), 0)

bmp, status = get_bitmap(Path)
C, G = [], []

if bmp is None:
    Size = "0x0"
    Report = "Image not available. " + status
else:
    w, h = bmp.Width, bmp.Height
    Size = "{}x{}".format(w, h)
    for p in UV:
        u, v = as_uv2(p)
        u = wrap01(u, m)
        v = wrap01(v, m)
        if FlipV:
            v = 1.0 - v
        x = u * (w - 1)
        y = v * (h - 1)
        col = bilinear_sample(bmp, x, y)
        C.append(col)
        G.append(to_gray01(col))
    Report = "OK ({})".format(status)
# ---------- end image_sampler ----------
data = Data(image_sampler.G)
bnd = Bounds(Numbers=flatten(data))

trigrid = Triangular(Plane=PlaneXY(0, 0, 0), Size=number_slider_2, ExtentX=round_2.Floor, ExtentY=round.Floor)  # -> flatten(Cells), Points
hexgrid = Hexagonal(Plane=point, Size=number_slider_2, ExtentX=round_4.Floor, ExtentY=round_3.Floor)  # -> flatten(Cells), Points
negative_2 = Negative(Value=number_slider_9)  # disabled

cell_scale_start_3 = Number(Slider(0.1, range=0..1))
cell_scale_end_3 = Number(Slider(0.85, range=0..1))
cell_scale_3 = Number(Slider(1, range=0..1))

number_slider_10 = Slider(1, range=0..1)  # disabled
number_slider_11 = Slider(0.85, range=0..1)  # disabled
number_slider_12 = Slider(0.1, range=0..1)  # disabled
number_slider_13 = Slider(10, range=0..10)  # disabled
panel_4 = Panel("C:\Users\fharker\Downloads\luke-bender-uVcjUFOy-Gk-unsplash.jpg")
number_slider_14 = Slider(10, range=0..10)  # disabled

multiplication = Multiplication(A=cell_scale, B=cell_scale_start)
multiplication_2 = Multiplication(A=cell_scale, B=cell_scale_end)
num = Number(multiplication)
num_2 = Number(multiplication_2)
dom = ConstructDomain(DomainStart=num, DomainEnd=num_2)

number_slider_15 = Slider(9, range=0..10)  # disabled
number_slider_16 = Slider(10, range=0..10)  # disabled
multiplication_3 = Multiplication(A=cell_scale_2, B=cell_scale_start_2)
offset_curve_2 = OffsetCurve(Curve=hexagonal.Cells, Distance=negative_2, Corners=1)  # disabled
multiplication_4 = Multiplication(A=cell_scale_2, B=cell_scale_end_2)
item_2 = ListItem(List=trigrid.Cells, Index=0, Wrap=True)  # -> Item, Item1

panel_5 = Panel("""Clamp
Repeat
Mirror""")
item_3 = ListItem(List=panel_5, Index=Slider(0, range=0..10), Wrap=True)

area_4 = Area(Geometry=item_2.Item)  # -> Area, Centroid
curve_4 = Curve(offset_curve_2)  # disabled
cell_scale_start_4 = Number(number_slider_12)  # disabled
panel_6 = Panel("C:\Users\minofuentes\Downloads\water.jpeg")  # disabled
cell_scale_end_4 = Number(number_slider_11)  # disabled
cell_scale_4 = Number(number_slider_10)  # disabled
num_3 = Number(multiplication_3)
num_4 = Number(multiplication_4)
item_4 = ListItem(List=hexgrid.Cells, Index=0, Wrap=True)
area_5 = Area(Geometry=curve_4)  # -> Area, Centroid; disabled
crv_3 = Curve(item_2.Item)
rectangular = Rectangular(
    Plane=PlaneXY(0, 0, 0),
    SizeX=number_slider_14,
    SizeY=number_slider_16,
    ExtentX=number_slider_13,
    ExtentY=number_slider_15)  # -> Cells, Points; disabled
area_6 = Area(Geometry=crv_3)  # -> Area, Centroid

multiplication_5 = Multiplication(A=cell_scale_3, B=cell_scale_start_3)
multiplication_6 = Multiplication(A=cell_scale_3, B=cell_scale_end_3)
num_5 = Number(multiplication_5)
num_6 = Number(multiplication_6)
dom_2 = ConstructDomain(DomainStart=num_5, DomainEnd=num_6)

bbox_2 = BoundingBox(Content=flatten(curve_3), Plane=point_2, UnionBox=True)  # -> Box, Box_2
debrep_2 = DeconstructBrep(Brep=bbox_2.Box)  # -> flatten(Faces), Edges, Vertices
pt_2 = Point(area_3.Centroid)
srf_cp_2 = SurfaceClosestPoint(Point=pt_2, Surface=reparameterize(debrep_2.Faces))  # -> Point, UVPoint, Distance
image_sampler_2 = GhPythonScript(Path=panel_3, UV=flatten(srf_cp_2.UVPoint), Mode=item_3, FlipV=Slider(1, range=0..1))  # -> C, G, Size, Report; inputs UV: list of Point3d, FlipV: Boolean; same code as image_sampler
data_2 = Data(image_sampler_2.G)
bnd_2 = Bounds(Numbers=flatten(data_2))
remap = RemapNumbers(Value=data_2, Source=bnd_2, Target=dom_2)  # -> Mapped, Clipped

remap_2 = RemapNumbers(Value=data, Source=bnd, Target=dom)  # -> Mapped, Clipped
discontinuity_2 = Discontinuity(Curve=rectangular.Cells, Level=1)  # -> Points, Parameters; disabled
area_7 = Area(Geometry=rectangular.Cells)  # -> Area, Centroid; disabled
unit_z = UnitZ(Factor=1)  # disabled
scale = Scale(Geometry=crv_3, Center=area_6.Centroid, Factor=number_slider_8)  # -> Geometry, Transform
disc = Discontinuity(Curve=crv_3, Level=1)  # -> Points, Parameters
panel_7 = Panel("""Clamp
Repeat
Mirror""")  # disabled
number_slider_17 = Slider(0, range=0..10)  # disabled

multiplication_7 = Multiplication(A=cell_scale_4, B=cell_scale_start_4)  # disabled
multiplication_8 = Multiplication(A=cell_scale_4, B=cell_scale_end_4)  # disabled
num_7 = Number(multiplication_7)  # disabled
num_8 = Number(multiplication_8)  # disabled
dom_3 = ConstructDomain(DomainStart=num_7, DomainEnd=num_8)  # disabled

explode = Explode(Curve=scale.Geometry, Recursive=True)  # -> Segments, Vertices
list_item_2 = ListItem(List=discontinuity_2.Points, Index=0, Wrap=True)  # -> Item, Item1, Item2, Item3; disabled
scale_2 = Scale(Geometry=geometry, Center=area_2.Centroid, Factor=remap_2.Mapped)  # -> Geometry, Transform
midpt = CurveMiddle(Curve=explode.Segments)
item_5 = ListItem(List=panel_7, Index=number_slider_17, Wrap=True)  # disabled

bbox_3 = BoundingBox(Content=flatten(curve_4), Plane=point_3, UnionBox=True)  # -> Box, Box_2; disabled
debrep_3 = DeconstructBrep(Brep=bbox_3.Box)  # -> flatten(Faces), Edges, Vertices; disabled
pt_3 = Point(area_5.Centroid)  # disabled
srf_cp_3 = SurfaceClosestPoint(Point=pt_3, Surface=reparameterize(debrep_3.Faces))  # -> Point, UVPoint, Distance; disabled
number_slider_18 = Slider(1, range=0..1)  # disabled
image_sampler_3 = GhPythonScript(Path=panel_6, UV=flatten(srf_cp_3.UVPoint), Mode=item_5, FlipV=number_slider_18)  # -> C, G, Size, Report; inputs UV: list of Point3d, FlipV: Boolean; disabled; same code as image_sampler
data_3 = Data(image_sampler_3.G)  # disabled
bnd_3 = Bounds(Numbers=flatten(data_3))  # disabled

move = Move(Geometry=area_7.Centroid, Motion=unit_z)  # -> Geometry, Transform; disabled
list_item_3 = ListItem(Index=0, Wrap=True)  # disabled
panel_8 = Panel(remap.Mapped)
shift = ShiftList(List=disc.Points, Shift=1, Wrap=True)
division_9 = Division(A=panel_8, B=Slider(1.032, range=0..10))
curve_5 = Curve(scale_2.Geometry)
curve_6 = Curve(geometry)
area_8 = Area(Geometry=item_4)  # -> Area, Centroid
area_9 = Area(Geometry=hexgrid.Cells)  # -> Area, Centroid
explode_2 = Explode(Curve=curve_3, Recursive=True)  # -> Segments, Vertices
ln = Line(StartPoint=shift, EndPoint=midpt)
scale_3 = Scale(Geometry=flatten(curve_3), Center=flatten(area_3.Centroid), Factor=remap.Mapped)  # -> Geometry, Transform
ln_2 = Line(StartPoint=disc.Points, EndPoint=midpt)
unit_z_2 = UnitZ(Factor=division_9)
panel_9 = Panel("""Clamp
Repeat
Mirror""")
_4point_surface = _4PointSurface(CornerA=graft(area_7.Centroid), CornerB=list_item_2.Item1, CornerC=list_item_2.Item2)  # disabled
_4point_surface_2 = _4PointSurface(CornerA=graft(area_7.Centroid), CornerB=list_item_2.Item, CornerC=list_item_2.Item1)  # disabled
_4point_surface_3 = _4PointSurface(CornerA=graft(area_7.Centroid), CornerB=list_item_2.Item, CornerC=list_item_2.Item3)  # disabled
_4point_surface_4 = _4PointSurface(CornerA=graft(area_7.Centroid), CornerB=list_item_2.Item2, CornerC=list_item_2.Item3)  # disabled
number_slider_19 = Slider(6, range=0..10)
number_slider_20 = Slider(360, range=0..1000)
pt_4 = Point(Point(0, 0, 0))
weave = Weave(Pattern=[0, 1], Stream0=ln_2, Stream1=ln, NullGaps=False)
remap_3 = RemapNumbers(Value=data_3, Source=bnd_3, Target=dom_3)  # -> Mapped, Clipped; disabled
number_slider_21 = Slider(0.237, range=0..10)  # disabled
surface_5 = Surface(_4point_surface)  # disabled
surface_6 = Surface(_4point_surface_3)  # disabled
surface_7 = Surface(_4point_surface_4)  # disabled
surface_8 = Surface(_4point_surface_2)  # disabled
item_6 = ListItem(List=panel_9, Index=Slider(0, range=0..10), Wrap=True)

number_slider_22 = Slider(0.405, range=0..1)  # disabled
negative_3 = Negative(Value=number_slider_22)  # disabled
unit_z_3 = UnitZ(Factor=negative_3)  # disabled

move_2 = Move(Geometry=scale_3.Geometry, Motion=unit_z_2)  # -> Geometry, Transform
join = JoinCurves(Curves=weave, Preserve=False)
panel_10 = Panel(remap_3.Mapped)  # disabled
arrpolar = PolarArray(Geometry=item_2.Item, Plane=pt_4, Count=number_slider_19, Angle=degrees(number_slider_20))  # -> Geometry, Transform
explode_3 = Explode(Curve=surface_5, Recursive=True)  # -> Segments, Vertices; disabled
explode_4 = Explode(Curve=surface_6, Recursive=True)  # -> Segments, Vertices; disabled
explode_5 = Explode(Curve=surface_7, Recursive=True)  # -> Segments, Vertices; disabled
explode_6 = Explode(Curve=surface_8, Recursive=True)  # -> Segments, Vertices; disabled
division_10 = Division(A=panel_10, B=number_slider_21)  # disabled
dom_4 = ConstructDomain(DomainStart=num_3, DomainEnd=num_4)
arrpolar_2 = PolarArray(Geometry=join, Plane=pt_4, Count=number_slider_19, Angle=degrees(number_slider_20))  # -> Geometry, Transform
scale_4 = Scale(Geometry=flatten(curve_4), Center=flatten(area_5.Centroid), Factor=remap_3.Mapped)  # -> Geometry, Transform; disabled
scale_5 = Scale(Geometry=flatten(curve_4), Center=flatten(area_5.Centroid), Factor=0.5)  # -> Geometry, Transform; disabled
explode_7 = Explode(Curve=curve_4, Recursive=True)  # -> Segments, Vertices; disabled
list_item_4 = ListItem(List=explode_3.Segments, Index=0, Wrap=True)  # -> Item, Item1, Item2; disabled
unit_z_4 = UnitZ(Factor=division_10)  # disabled
list_item_5 = ListItem(List=explode_4.Segments, Index=0, Wrap=True)  # -> Item, Item1, Item2; disabled
number_slider_23 = Slider(318, range=0..1000)  # disabled
list_item_6 = ListItem(List=explode_5.Segments, Index=0, Wrap=True)  # -> Item, Item1, Item2; disabled
list_item_7 = ListItem(List=explode_6.Segments, Index=0, Wrap=True)  # -> Item, Item1, Item2; disabled
explode_8 = Explode(Curve=move_2.Geometry, Recursive=True)  # -> Segments, Vertices
ln_3 = Line(StartPoint=area_8.Centroid, EndPoint=area_9.Centroid)
curve_middle = CurveMiddle(Curve=list_item_4.Item2)  # disabled
curve_middle_2 = CurveMiddle(Curve=list_item_5.Item2)  # disabled
curve_middle_3 = CurveMiddle(Curve=list_item_6.Item2)  # disabled
curve_middle_4 = CurveMiddle(Curve=list_item_7.Item2)  # disabled
move_3 = Move(Geometry=graft(arrpolar.Geometry), Motion=ln_3)  # -> flatten(Geometry), Transform
bbox_4 = BoundingBox(Content=flatten(move_3.Geometry), Plane=area_4.Centroid, UnionBox=True)  # -> Box, Box_2
area_10 = Area(Geometry=move_3.Geometry)  # -> Area, Centroid
debrep_4 = DeconstructBrep(Brep=bbox_4.Box)  # -> flatten(Faces), Edges, Vertices
pt_5 = Point(area_10.Centroid)
srf_cp_4 = SurfaceClosestPoint(Point=pt_5, Surface=reparameterize(debrep_4.Faces))  # -> Point, UVPoint, Distance
image_sampler_4 = GhPythonScript(Path=panel_4, UV=flatten(srf_cp_4.UVPoint), Mode=item_6, FlipV=Slider(1, range=0..1))  # -> C, G, Size, Report; inputs UV: list of Point3d, FlipV: Boolean; same code as image_sampler
data_4 = Data(image_sampler_4.G)
cull_duplicates = CullDuplicates(Points=explode_7.Vertices, Tolerance=0.1, CullMode=3)  # -> Points, Indices, Valence; disabled
move_4 = Move(Geometry=scale_4.Geometry, Motion=unit_z_4)  # -> Geometry, Transform; disabled
move_5 = Move(Geometry=graft(arrpolar_2.Geometry), Motion=ln_3)  # -> flatten(Geometry), Transform
curve_middle_5 = CurveMiddle(Curve=explode_8.Segments)
bnd_4 = Bounds(Numbers=flatten(data_4))
explode_9 = Explode(Curve=move_4.Geometry, Recursive=True)  # -> Segments, Vertices; disabled
area_11 = Area(Geometry=move_5.Geometry)  # -> Area, Centroid
remap_4 = RemapNumbers(Value=data_4, Source=bnd_4, Target=dom_4)  # -> Mapped, Clipped
cull_duplicates_2 = CullDuplicates(Points=explode_2.Vertices, Tolerance=0.1, CullMode=3)  # -> Points, Indices, Valence
curve_7 = Curve(flatten(move_2.Geometry))
curve_8 = Curve(flatten(move_4.Geometry))  # disabled
rotate_3d = Rotate3D(Geometry=surface_5, Angle=degrees(number_slider_23), Center=curve_middle, Axis=list_item_4.Item2)  # -> Geometry, Transform; disabled
rotate_3d_2 = Rotate3D(Geometry=surface_6, Angle=expr("-x", degrees(number_slider_23)), Center=curve_middle_2, Axis=list_item_5.Item2)  # -> Geometry, Transform; disabled
list_item_8 = ListItem(List=curve_middle_5, Index=0, Wrap=True)  # -> Item, Item1, Item2
rotate_3d_3 = Rotate3D(Geometry=surface_7, Angle=degrees(number_slider_23), Center=curve_middle_3, Axis=list_item_6.Item2)  # -> Geometry, Transform; disabled
rotate_3d_4 = Rotate3D(Geometry=surface_8, Angle=degrees(number_slider_23), Center=curve_middle_4, Axis=list_item_7.Item2)  # -> Geometry, Transform; disabled
scale_6 = Scale(Geometry=move_5.Geometry, Center=area_11.Centroid, Factor=remap_4.Mapped)  # -> Geometry, Transform
scale_7 = Scale(Geometry=move_3.Geometry, Center=area_11.Centroid, Factor=remap_4.Mapped)  # -> Geometry, Transform
list_item_9 = ListItem(List=curve_7, Index=0, Wrap=True)
list_item_10 = ListItem(List=curve_8, Index=0, Wrap=True)  # disabled
curve_middle_6 = CurveMiddle(Curve=explode_9.Segments)  # disabled
point_4 = Point(list_item_8.Item2)
list_item_11 = ListItem(List=cull_duplicates_2.Points, Index=0, Wrap=True)  # -> Item, Item1, Item2
discontinuity_3 = Discontinuity(Curve=list_item_9, Level=1)  # -> Points, Parameters
discontinuity_4 = Discontinuity(Curve=list_item_10, Level=1)  # -> Points, Parameters; disabled
curve_9 = Curve(scale_7.Geometry)
curve_10 = Curve(surface_4)

crv_4 = Curve(scale_6.Geometry)
crv_5 = Curve(move_3.Geometry)

list_item_12 = ListItem(List=curve_middle_6, Index=0, Wrap=True)  # -> Item, Item1, Item2, Item3, Item4, Item5; disabled
list_item_13 = ListItem(List=cull_duplicates.Points, Index=0, Wrap=True)  # -> Item, Item1, Item2, Item3, Item4, Item5; disabled
_4point_surface_5 = _4PointSurface(CornerA=point_4, CornerB=list_item_11.Item1, CornerC=list_item_11.Item2)
negative_4 = Negative(Value=Slider(0.405, range=0..1))
list_length = ListLength(List=discontinuity_3.Points)
list_length_2 = ListLength(List=discontinuity_4.Points)  # disabled
curve_11 = Curve(offset_curve_2)  # disabled
unit_z_5 = UnitZ(Factor=negative_4)
point_5 = Point([list_item_13.Item2, list_item_13.Item1])  # disabled
point_6 = Point([list_item_13.Item3, list_item_13.Item4])  # disabled
xy_plane = XYPlane(Origin=Point(0, 0, 0))
xy_plane_2 = XYPlane(Origin=Point(0, 0, 0))
xy_plane_3 = XYPlane(Origin=Point(0, 0, 0))
area_12 = Area(Geometry=offset_curve_2)  # -> Area, Centroid; disabled
region_intersection = RegionIntersection(CurvesA=crv_5, CurvesB=curve_10, Plane=xy_plane)
region_intersection_2 = RegionIntersection(CurvesA=crv_4, CurvesB=curve_10, Plane=xy_plane_2)
_4point_surface_6 = _4PointSurface(CornerA=list_item_12.Item5, CornerB=list_item_13.Item4, CornerC=list_item_13.Item5)  # disabled
region_intersection_3 = RegionIntersection(CurvesA=curve_9, CurvesB=curve_10, Plane=xy_plane_3)

polar_array = PolarArray(Geometry=_4point_surface_5, Plane=area_3.Centroid, Count=list_length, Angle=degrees(Slider(360, range=0..1000)))  # -> Geometry, Transform
extrude = Extrude(Base=triangular.Cells, Direction=unit_z_5)
boundary_surfaces = BoundarySurfaces(Edges=flatten([offset_curve, triangular.Cells]))

number_slider_24 = Slider(360, range=0..1000)  # disabled
extrude_2 = Extrude(Base=hexagonal.Cells, Direction=unit_z_3)  # disabled
boundary_surfaces_2 = BoundarySurfaces(Edges=flatten([hexagonal.Cells, offset_curve_2]))  # disabled
polar_array_2 = PolarArray(Geometry=_4point_surface_6, Plane=area_12.Centroid, Count=list_length_2, Angle=degrees(number_slider_24))  # -> Geometry, Transform; disabled
crv_6 = Curve(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)
cell_scale_start_5 = Number(Slider(0.1, range=0..1))
cell_scale_end_5 = Number(Slider(0.8, range=0..1))
cell_scale_5 = Number(Slider(1, range=0..1))

diamond_grid_2 = DiamondGrid(Surface=crv_6, UDivisions=Slider(60, range=0..100), VDivisions=Slider(100, range=0..100))  # -> CornerPoint1, CornerPoint2, CornerPoint3, CornerPoint4, MidPoint, Normals
line_4 = Line(StartPoint=diamond_grid_2.CornerPoint2, EndPoint=diamond_grid_2.CornerPoint3)
line_5 = Line(StartPoint=diamond_grid_2.CornerPoint1, EndPoint=diamond_grid_2.CornerPoint2)
curve_12 = Curve([line_5, line_4])
join_curves_2 = JoinCurves(Curves=curve_12, Preserve=False)
surface_split_2 = SurfaceSplit(Surface=crv_6, Curves=flatten(join_curves_2))

area_13 = Area(Geometry=crv_6)  # -> Area, Centroid
panel_11 = Panel("C:\Users\fharker\Downloads\luke-bender-uVcjUFOy-Gk-unsplash.jpg")
geometry_2 = Geometry(surface_split_2)
panel_12 = Panel("""Clamp
Repeat
Mirror""")
area_14 = Area(Geometry=geometry_2)  # -> Area, Centroid
item_7 = ListItem(List=panel_12, Index=Slider(0, range=0..10), Wrap=True)

bbox_5 = BoundingBox(Content=flatten(geometry_2), Plane=area_13.Centroid, UnionBox=True)  # -> Box, Box_2
debrep_5 = DeconstructBrep(Brep=bbox_5.Box)  # -> flatten(Faces), Edges, Vertices
pt_6 = Point(area_14.Centroid)
srf_cp_5 = SurfaceClosestPoint(Point=pt_6, Surface=reparameterize(debrep_5.Faces))  # -> Point, UVPoint, Distance
image_sampler_5 = GhPythonScript(Path=panel_11, UV=flatten(srf_cp_5.UVPoint), Mode=item_7, FlipV=Slider(1, range=0..1))  # -> C, G, Size, Report; inputs UV: list of Point3d, FlipV: Boolean; same code as image_sampler
data_5 = Data(image_sampler_5.G)
bnd_5 = Bounds(Numbers=flatten(data_5))

multiplication_9 = Multiplication(A=cell_scale_5, B=cell_scale_start_5)
multiplication_10 = Multiplication(A=cell_scale_5, B=cell_scale_end_5)
num_9 = Number(multiplication_9)
num_10 = Number(multiplication_10)
dom_5 = ConstructDomain(DomainStart=num_9, DomainEnd=num_10)

remap_5 = RemapNumbers(Value=data_5, Source=bnd_5, Target=dom_5)  # -> Mapped, Clipped
scale_8 = Scale(Geometry=geometry_2, Center=area_14.Centroid, Factor=remap_5.Mapped)  # -> Geometry, Transform
curve_13 = Curve(scale_8.Geometry)
curve_14 = Curve(geometry_2)
