# Grasshopper definition bus-hab-v1.gh (Grasshopper 1.0.8)

panel = Panel("C:\Users\fharker\Documents\GitHub-Local\hub-alexandria\alex-babel\projects\curve-attracted-geos\attractor-geo-test.csv")
pt = Point(Point(0, 0, 0))
xz = XZPlane(Origin=pt)
paramexporter = Python3Script(Export=Button(), CSV_File=panel)  # inputs Export: Boolean
# ---------- paramexporter: Python ----------
"""
Grasshopper CSV Parameter Exporter

Instructions:
1. Place a Python script component on your Grasshopper canvas.
2. Create two inputs on the component:
   - `Export` (Type hint: bool)
   - `CSV_File` (Type hint: str)
3. Copy and paste this script into the component.
4. Wire a Button to `Export`.
5. Wire a File Path or Panel containing the CSV path to `CSV_File`.

This script finds top-level inputs (components with no incoming wires and a custom NickName),
extracts their values or sets up reference links, and writes them to a CSV.
"""

import os
import csv
import Grasshopper as gh

def get_gh_doc():
    if 'ghenv' in globals():
        return ghenv.Component.OnPingDocument()
    if 'ghdoc' in globals():
        return ghdoc
    return None

def is_top_level(obj):
    # Check if the object is a parameter and has no incoming wires
    if isinstance(obj, gh.Kernel.IGH_Param):
        return obj.SourceCount == 0
    return False

def has_custom_nickname(obj):
    # Check if the NickName is different from the default Name
    return obj.NickName != obj.Name

def get_param_type_str(obj):
    type_name = obj.TypeName.lower()

    if "number" in type_name or "float" in type_name or "double" in type_name:
        return "float"
    elif "integer" in type_name or "int" in type_name:
        return "int"
    elif "string" in type_name or "text" in type_name:
        return "string"
    elif "boolean" in type_name or "bool" in type_name:
        return "bool"
    elif "curve" in type_name or "crv" in type_name:
        return "crv"
    elif "point" in type_name or "pt" in type_name:
        return "pt"
    elif "geometry" in type_name or "geo" in type_name:
        return "geo"
    elif "brep" in type_name:
        return "brep"
    elif "surface" in type_name or "srf" in type_name:
        return "srf"

    # Check if it's a Slider, Toggle, or Panel
    if isinstance(obj, gh.Kernel.Special.GH_NumberSlider):
        return "float" # or int based on slider type, but float is safe
    elif isinstance(obj, gh.Kernel.Special.GH_BooleanToggle):
        return "bool"
    elif isinstance(obj, gh.Kernel.Special.GH_Panel):
        return "string"

    # Default to geo for unknown types as a fallback for referenced geometry
    return "geo"

def extract_value(obj, type_str):
    # For geometry/reference types, we output the NickName as the value
    if type_str in ['crv', 'pt', 'geo', 'brep', 'srf']:
        return obj.NickName

    # For primitive types, we try to extract the value
    if isinstance(obj, gh.Kernel.Special.GH_NumberSlider):
        return str(obj.CurrentValue)
    elif isinstance(obj, gh.Kernel.Special.GH_BooleanToggle):
        return str(obj.Value)
    elif isinstance(obj, gh.Kernel.Special.GH_Panel):
        return str(obj.UserText)

    # For standard parameters, read from VolatileData or PersistentData
    if isinstance(obj, gh.Kernel.IGH_Param):
        if obj.VolatileDataCount > 0:
            first_branch = obj.VolatileData.Branches[0]
            if first_branch.Count > 0:
                # GH_Type wrappers have a Value property
                if hasattr(first_branch[0], 'Value'):
                    return str(first_branch[0].Value)
                else:
                    return str(first_branch[0])
        elif not obj.PersistentData.IsEmpty:
            first_branch = obj.PersistentData.Branches[0]
            if first_branch.Count > 0:
                if hasattr(first_branch[0], 'Value'):
                    return str(first_branch[0].Value)
                else:
                    return str(first_branch[0])

    return ""

def main():
    if 'Export' not in globals() or not Export:
        return

    if 'CSV_File' not in globals() or not CSV_File:
        print("Invalid CSV file path or CSV_File input not provided")
        return

    doc = get_gh_doc()
    if not doc:
        print("Could not find Grasshopper document context")
        return

    export_data = []
    export_data.append(["item name", "type", "value"])

    for obj in doc.Objects:
        # We look for IGH_Param (standard parameters) or Special objects (Slider, Toggle, Panel)
        is_param = isinstance(obj, gh.Kernel.IGH_Param)
        is_special = isinstance(obj, (gh.Kernel.Special.GH_NumberSlider, gh.Kernel.Special.GH_BooleanToggle, gh.Kernel.Special.GH_Panel))

        if is_param or is_special:
            if is_top_level(obj) and has_custom_nickname(obj):
                type_str = get_param_type_str(obj)
                val_str = extract_value(obj, type_str)

                name_str = obj.NickName

                # For geometry, output name as {NickName}-1
                if type_str in ['crv', 'pt', 'geo', 'brep', 'srf']:
                    name_str = "{}-1".format(name_str)

                export_data.append([name_str, type_str, val_str])

    if len(export_data) <= 1:
        print("No eligible components found to export.")
        return

    try:
        # Ensure directory exists
        dir_name = os.path.dirname(CSV_File)
        if dir_name and not os.path.exists(dir_name):
            os.makedirs(dir_name)

        with open(CSV_File, mode='w', newline='') as f:
            writer = csv.writer(f)
            writer.writerows(export_data)

        print("Successfully exported {} parameters to {}.".format(len(export_data) - 1, CSV_File))
    except Exception as e:
        print("Error writing to CSV: {}".format(e))

if __name__ == "__main__":
    main()
# ---------- end paramexporter ----------
paramcontroller = Python3Script(Update=Button(), CSV_File=panel)  # inputs Update: Boolean, CSV_File: String
# ---------- paramcontroller: Python ----------
"""
Grasshopper CSV Parameter Updater

Instructions:
1. Place a Python script component on your Grasshopper canvas.
2. Create two inputs on the component:
   - `Update` (Type hint: bool)
   - `CSV_File` (Type hint: str)
3. Copy and paste this script into the component.
4. Wire a Button or Boolean Toggle to `Update`.
5. Wire a File Path or Panel containing the CSV path to `CSV_File`.

The CSV must have columns: `input name`, `type`, `value`
"""

import os
import csv
import Grasshopper as gh
import System

def get_gh_doc():
    if 'ghenv' in globals():
        return ghenv.Component.OnPingDocument()
    if 'ghdoc' in globals():
        # Depending on environment, ghdoc might be the document itself
        return ghdoc
    return None

def find_param_by_nickname(doc, nickname):
    matched_params = []
    # Search for floating parameters directly on the canvas
    for obj in doc.Objects:
        if isinstance(obj, gh.Kernel.IGH_Param):
            if obj.NickName == nickname:
                matched_params.append(obj)
    return matched_params

def update_param_value(param, type_str, value_str, doc):
    type_str = type_str.lower().strip()
    value_str = value_str.strip()

    # Handle primitives
    if type_str in ['float', 'num', 'number', 'double']:
        try:
            val = float(value_str)
            param.PersistentData.Clear()
            param.PersistentData.Append(gh.Kernel.Types.GH_Number(val))
            return True
        except ValueError:
            print("Error parsing {} as float".format(value_str))

    elif type_str in ['int', 'integer']:
        try:
            val = int(value_str)
            param.PersistentData.Clear()
            param.PersistentData.Append(gh.Kernel.Types.GH_Integer(val))
            return True
        except ValueError:
            print("Error parsing {} as int".format(value_str))

    elif type_str in ['string', 'str', 'text']:
        param.PersistentData.Clear()
        param.PersistentData.Append(gh.Kernel.Types.GH_String(value_str))
        return True

    elif type_str in ['bool', 'boolean']:
        val = value_str.lower() in ['true', '1', 't', 'yes', 'y']
        param.PersistentData.Clear()
        param.PersistentData.Append(gh.Kernel.Types.GH_Boolean(val))
        return True

    # Handle reference types (geometry, etc) where value_str is the NickName of the source
    elif type_str in ['crv', 'curve', 'pt', 'point', 'geo', 'geometry', 'brep', 'srf', 'surface']:
        source_params = find_param_by_nickname(doc, value_str)
        if not source_params:
            print("Could not find source parameter with nickname '{}' on canvas".format(value_str))
            return False

        source_param = source_params[0]

        # Wire source to this param
        param.RemoveAllSources()
        param.AddSource(source_param)
        return True

    else:
        print("Unsupported type: {}".format(type_str))
        return False

# Global to store pending updates
PENDING_UPDATES = []

def schedule_callback(ghdoc):
    # This callback runs when the solution is finished and triggers a new one
    global PENDING_UPDATES

    if not PENDING_UPDATES:
        return

    updated_count = 0
    for param, type_str, value_str in PENDING_UPDATES:
        param.RecordUndoEvent("CSV Update")
        if update_param_value(param, type_str, value_str, ghdoc):
            param.ExpireSolution(False)
            updated_count += 1

    PENDING_UPDATES = []

    if updated_count > 0:
        print("Successfully updated {} parameters.".format(updated_count))
        # Start a new solution to recalculate with the new values
        ghdoc.NewSolution(False)

def main():
    global PENDING_UPDATES
    # Check inputs (which are provided as globals by the GH Python component)
    if 'Update' not in globals() or not Update:
        return

    if 'CSV_File' not in globals() or not CSV_File or not os.path.exists(CSV_File):
        print("Invalid CSV file path or CSV_File input not provided")
        return

    doc = get_gh_doc()
    if not doc:
        print("Could not find Grasshopper document context")
        return

    updated_count = 0

    # Read the CSV file
    with open(CSV_File, mode='r') as f:
        reader = csv.reader(f)
        # Handle python 2/3 next() compatibility
        try:
            headers = next(reader)
        except StopIteration:
            headers = None

        if not headers:
            print("Empty CSV file")
            return

        header_lower = [h.lower().strip() for h in headers]

        try:
            name_idx = header_lower.index("input name")
            type_idx = header_lower.index("type")
            value_idx = header_lower.index("value")
        except ValueError:
            print("Warning: Could not find exact headers 'input name', 'type', 'value'. Assuming columns 0, 1, 2.")
            name_idx, type_idx, value_idx = 0, 1, 2

        PENDING_UPDATES = []
        for row in reader:
            if len(row) <= max(name_idx, type_idx, value_idx):
                continue

            input_name = row[name_idx]
            input_type = row[type_idx]
            input_value = row[value_idx]

            target_params = find_param_by_nickname(doc, input_name)
            if not target_params:
                print("Warning: No parameter found with NickName '{}'".format(input_name))
                continue

            for param in target_params:
                PENDING_UPDATES.append((param, input_type, input_value))
                updated_count += 1

    if updated_count > 0:
        # Schedule a solution to update values outside the current solution
        delegate = gh.Kernel.GH_Document.GH_ScheduleDelegate(schedule_callback)
        doc.ScheduleSolution(5, delegate)

if __name__ == "__main__":
    main()
# ---------- end paramcontroller ----------
number_slider = Slider(12, range=0..100)
rectangle = Rectangle(Plane=xz, XSize=Slider(60, range=0..100), YSize=Slider(108, range=0..1000), Radius=0)  # -> Rectangle, Length
division = Division(A=Slider(144, range=0..1000), B=number_slider)
Y = UnitY(Factor=number_slider)
arrlinear = LinearArray(Geometry=rectangle.Rectangle, Direction=Y, Count=division)  # -> Geometry, Transform
crv = Curve(arrlinear.Geometry)

number_slider_2 = Slider(1, range=0..10)  # disabled
number_slider_3 = Slider(8, range=0..10)  # disabled
number_slider_4 = Slider(16, range=0..100)  # disabled
number_slider_5 = Slider(120, range=0..1000)  # disabled
pt_2 = Point(Point(0, 0, 0))  # disabled
pt_3 = Point(Point(0, 0, 0))  # disabled
rectangle_2 = Rectangle(Plane=pt_3, XSize=number_slider_5, YSize=number_slider_5, Radius=0)  # -> Rectangle, Length; disabled
cir = Circle(Plane=pt_2, Radius=number_slider_2)  # disabled
number_slider_6 = Slider(1, range=0..1)  # disabled
number_slider_7 = Slider(6, range=0..10)  # disabled
number_slider_8 = Slider(2, range=0..10)  # disabled
series = Series(Start=0, Step=number_slider_4, Count=number_slider_3)  # disabled
Z = UnitZ(Factor=series)  # disabled
number_slider_9 = Slider(12, range=0..100)  # disabled
number_slider_10 = Slider(3, range=0..100)  # disabled
number_slider_11 = Slider(3, range=0..10)  # disabled
grid_in_region = GridInRegion(B=rectangle_2.Rectangle, RadX=number_slider_7, Type=number_slider_8)  # -> GridCells, R, C; inputs B: Curve, RadX: Double, RadY: Double, Type: Boolean; disabled
# ---------- grid_in_region: Python ----------
import math
import Rhino
from Rhino.Geometry import Point3d, Polyline, PolylineCurve
from Rhino.Geometry.Intersect import Intersection
from Grasshopper import DataTree
from Grasshopper.Kernel.Data import GH_Path

def _is_closed_planar(crv, tol):
    if crv is None: return False
    if not crv.IsClosed: return False
    ok, _ = crv.TryGetPlane(tol)
    return ok

def _curve_plane(crv, tol):
    ok, pln = crv.TryGetPlane(tol)
    return pln if ok else None

def _hex_pts_xy(cx, cy, rx, ry):
    # pointy-top hex; rx stretches X, ry stretches Y
    pts = []
    for k in range(6):
        ang = math.radians(30.0 + 60.0 * k)
        pts.append((cx + rx * math.cos(ang), cy + ry * math.sin(ang)))
    return pts

def _rect_pts_xy(cx, cy, rx, ry):
    # axis-aligned rectangle; if rx==ry it's a square
    return [
        (cx - rx, cy - ry),
        (cx + rx, cy - ry),
        (cx + rx, cy + ry),
        (cx - rx, cy + ry),
    ]

def _poly_fully_inside(cell_crv, boundary, plane, tol):
    ok, pl = cell_crv.TryGetPolyline()
    if not ok:
        return False

    # all vertices must be inside (or on boundary)
    for i in range(pl.Count - 1):
        if boundary.Contains(pl[i], plane, tol) == Rhino.Geometry.PointContainment.Outside:
            return False

    # any intersection (including touching) rejects
    x = Intersection.CurveCurve(cell_crv, boundary, tol, tol)
    if x and x.Count > 0:
        return False

    return True

# ----------------------------
# Main
# ----------------------------
GridCells = []
R = DataTree[object]()  # rows
C = DataTree[object]()  # cols

if B is None or RadX is None:
    GridCells = []
else:
    tol = Rhino.RhinoDoc.ActiveDoc.ModelAbsoluteTolerance if Rhino.RhinoDoc.ActiveDoc else 1e-6

    rx = float(RadX)
    if rx <= 0.0:
        GridCells = []
    else:
        # Critical rule: if RadY == 0 -> regular polygons
        if RadY is None:
            ry = rx
        else:
            ry_in = float(RadY)
            ry = rx if abs(ry_in) <= tol else ry_in

        if not _is_closed_planar(B, tol):
            GridCells = []
        else:
            plane = _curve_plane(B, tol)

            # boundary plane coords -> World XY
            xform_w2p = Rhino.Geometry.Transform.ChangeBasis(plane, Rhino.Geometry.Plane.WorldXY)
            xform_p2w = Rhino.Geometry.Transform.ChangeBasis(Rhino.Geometry.Plane.WorldXY, plane)

            B2 = B.DuplicateCurve()
            B2.Transform(xform_w2p)

            mp = Rhino.Geometry.AreaMassProperties.Compute(B2)
            ctr2 = mp.Centroid if mp else B2.GetBoundingBox(True).Center

            use_hex = True if Type else False

            # Grid spacing derived from rx/ry
            if use_hex:
                dx = math.sqrt(3.0) * rx
                dy = 1.5 * ry
            else:
                dx = 2.0 * rx
                dy = 2.0 * ry

            bb = B2.GetBoundingBox(True)
            minx = bb.Min.X - 2.0 * dx
            maxx = bb.Max.X + 2.0 * dx
            miny = bb.Min.Y - 2.0 * dy
            maxy = bb.Max.Y + 2.0 * dy

            j_min = int(math.floor((miny - ctr2.Y) / dy)) - 1
            j_max = int(math.ceil((maxy - ctr2.Y) / dy)) + 1
            i_min = int(math.floor((minx - ctr2.X) / dx)) - 1
            i_max = int(math.ceil((maxx - ctr2.X) / dx)) + 1

            cells_by_row = {}  # j -> list of (i, curve)
            cells_by_col = {}  # i -> list of (j, curve)

            for j in range(j_min, j_max + 1):
                y = ctr2.Y + j * dy
                row_offset = (0.5 * dx if (use_hex and (j & 1)) else 0.0)

                for i in range(i_min, i_max + 1):
                    x = ctr2.X + i * dx + row_offset
                    cpt2 = Point3d(x, y, 0.0)

                    # quick cull: center must be inside
                    if B2.Contains(cpt2, Rhino.Geometry.Plane.WorldXY, tol) == Rhino.Geometry.PointContainment.Outside:
                        continue

                    # build candidate cell in plane coords (WorldXY)
                    if use_hex:
                        verts = _hex_pts_xy(x, y, rx, ry)
                    else:
                        verts = _rect_pts_xy(x, y, rx, ry)

                    pts = [Point3d(vx, vy, 0.0) for (vx, vy) in verts]
                    pts.append(pts[0])

                    pline = Polyline(pts)
                    if not pline.IsValid:
                        continue

                    cell2 = PolylineCurve(pline)

                    if not _poly_fully_inside(cell2, B2, Rhino.Geometry.Plane.WorldXY, tol):
                        continue

                    cell_w = cell2.DuplicateCurve()
                    cell_w.Transform(xform_p2w)

                    GridCells.append(cell_w)
                    cells_by_row.setdefault(j, []).append((i, cell_w))
                    cells_by_col.setdefault(i, []).append((j, cell_w))

            # Rows -> R (branches ordered by j, items ordered by i)
            row_keys = sorted(cells_by_row.keys())
            for r_idx, j in enumerate(row_keys):
                path = GH_Path(r_idx)
                for (_, crv) in sorted(cells_by_row[j], key=lambda t: t[0]):
                    R.Add(crv, path)

            # Cols -> C (branches ordered by i, items ordered by j)
            col_keys = sorted(cells_by_col.keys())
            for c_idx, i in enumerate(col_keys):
                path = GH_Path(c_idx)
                for (_, crv) in sorted(cells_by_col[i], key=lambda t: t[0]):
                    C.Add(crv, path)
# ---------- end grid_in_region ----------
move = Move(Geometry=cir, Motion=Z)  # -> Geometry, Transform; disabled
neg = Negative(Value=number_slider_6)  # disabled
area = Area(Geometry=move.Geometry)  # -> Area, Centroid; disabled
dom = ConstructDomain(DomainStart=number_slider_10, DomainEnd=number_slider_9)  # disabled
offset = OffsetCurve(Curve=grid_in_region.GridCells, Distance=neg, Corners=1)  # disabled
random = Random(Range=dom, Number=number_slider_3, Seed=number_slider_11)  # disabled
scale = Scale(Geometry=move.Geometry, Center=area.Centroid, Factor=random)  # -> Geometry, Transform; disabled
boundary = BoundarySurfaces(Edges=flatten([offset, grid_in_region.GridCells]))  # disabled
Z_2 = UnitZ(Factor=1)  # disabled
loft = Loft(Curves=scale.Geometry, Options={Adjust=False, Closed=False, LoftEnds=0, LoftSimp=0, LoftType=0, Rebuild=10, Refit=0.01})  # disabled
extr = Extrude(Base=boundary, Direction=Z_2)  # disabled
srf = Surface(loft)  # disabled
geo = Geometry(extr)  # disabled
number_slider_12 = Slider(0.66, range=0..1)  # disabled
number_slider_13 = Slider(1, range=0..1)  # disabled
bbox = BoundingBox(Content=geo, Plane=PlaneXY(0, 0, 0), UnionBox=True)  # -> Box, Box_2; disabled
srfmorph = SurfaceMorph(
    Geometry=geo,
    Reference=bbox.Box_2,
    Surface=reparameterize(srf),
    UDomain=number_slider_13,
    VDomain=number_slider_13,
    WDomain=number_slider_12)  # disabled

disc = Discontinuity(Curve=crv, Level=1)  # -> Points, Parameters
item = ListItem(List=disc.Points, Index=0, Wrap=True)  # -> Item, Item1, Item2, Item3
pt_4 = Point(item.Item3)
pt_5 = Point(item.Item2)
pt_6 = Point(item.Item)
pt_7 = Point(item.Item1)

pt_8 = Point(flatten(pt_7))

pt_9 = Point(flatten(pt_6))
fline = FitLine(Points=pt_9)
eval = EvaluateCurve(Curve=reparameterize(fline), Parameter=Slider(0.5, range=0..1))  # -> Point, Tangent, Angle
point_attractor = PointAttractor(A_2=eval.Point, B_2=flatten(pt_9), A=Slider(4, range=0..100), B=Slider(24, range=0..100))
X = UnitX(Factor=point_attractor)
neg_2 = Negative(Value=X)
move_2 = Move(Geometry=pt_9, Motion=X)  # -> graft(Geometry), Transform

pt_10 = Point(flatten(pt_4))
fline_2 = FitLine(Points=pt_10)
eval_2 = EvaluateCurve(Curve=reparameterize(fline_2), Parameter=Slider(0.5, range=0..1))  # -> Point, Tangent, Angle
point_attractor_2 = PointAttractor(A_2=eval_2.Point, B_2=flatten(pt_10), A=Slider(4, range=0..100), B=Slider(24, range=0..100))
Z_3 = UnitZ(Factor=point_attractor_2)
move_3 = Move(Geometry=pt_10, Motion=Z_3)  # -> graft(Geometry), Transform

pt_11 = Point(flatten(pt_5))
fline_3 = FitLine(Points=pt_11)
eval_3 = EvaluateCurve(Curve=reparameterize(fline_3), Parameter=Slider(0.5, range=0..1))  # -> Point, Tangent, Angle
point_attractor_3 = PointAttractor(A_2=eval_3.Point, B_2=flatten(pt_11), A=Slider(4, range=0..100), B=Slider(24, range=0..100))
Z_4 = UnitZ(Factor=point_attractor_3)
move_4 = Move(Geometry=pt_11, Motion=Z_4)  # -> graft(Geometry), Transform

fline_4 = FitLine(Points=pt_8)
eval_4 = EvaluateCurve(Curve=reparameterize(fline_4), Parameter=Slider(0.5, range=0..1))  # -> Point, Tangent, Angle
point_attractor_4 = PointAttractor(A_2=eval_4.Point, B_2=flatten(pt_8), A=Slider(96, range=0..100), B=Slider(84, range=0..100))
Z_5 = UnitZ(Factor=point_attractor_4)
move_5 = Move(Geometry=pt_8, Motion=Z_5)  # -> graft(Geometry), Transform

pt_12 = Point(flatten(move_5.Geometry))

fline_5 = FitLine(Points=pt_12)
eval_5 = EvaluateCurve(Curve=reparameterize(fline_5), Parameter=Slider(0.5, range=0..1))  # -> Point, Tangent, Angle
point_attractor_5 = PointAttractor(A_2=eval_5.Point, B_2=flatten(pt_12), A=Slider(4, range=0..100), B=Slider(24, range=0..100))
X_2 = UnitX(Factor=point_attractor_5)
neg_3 = Negative(Value=X_2)
move_6 = Move(Geometry=pt_12, Motion=X_2)  # -> graft(Geometry), Transform

simplify = SimplifyTree(Tree=move_6.Geometry, Front=False)
simplify_2 = SimplifyTree(Tree=move_4.Geometry, Front=False)
simplify_3 = SimplifyTree(Tree=move_3.Geometry, Front=False)
simplify_4 = SimplifyTree(Tree=move_2.Geometry, Front=False)
merge = Merge(Data1=simplify_4, Data2=simplify_3, Data3=simplify_2, Data4=simplify)
pline = PolyLine(Vertices=merge, Closed=False)
netsurf = NetworkSurface(Continuity=2)
offset_2 = OffsetCurve(Curve=pline, Distance=Slider(4, range=0..10), Corners=1)
edgesrf = EdgeSurface(CurveA=pline, CurveB=offset_2)
Y_2 = UnitY(Factor=Slider(4, range=0..10))
loft_2 = Loft(Curves=flatten(pline), Options={Adjust=False, Closed=False, LoftEnds=0, LoftSimp=0, LoftType=0, Rebuild=10, Refit=0.01})
extr_2 = Extrude(Base=edgesrf, Direction=Y_2)
geo_2 = Geometry(loft_2)
geo_3 = Geometry(extr_2)

# ==== cluster PointAttractor: Utility
A = ClusterInput()
x = ClusterInput()
A_2 = ClusterInput()
B = ClusterInput()
B_2 = ClusterInput()
dist = Distance(PointA=A_2, PointB=B_2)
dom = ConstructDomain(DomainStart=A, DomainEnd=B)
bnd = Bounds(Numbers=dist)
remap = RemapNumbers(Value=dist, Source=bnd, Target=dom)  # -> Mapped, Clipped
R = ClusterOutput(remap.Mapped)
