# Grasshopper definition bus-hab-v3.gh (Grasshopper 1.0.8)
# plug-ins: MetaHopper

file_option = Slider(4, range=1..100)
panel = Panel("C:\Users\fharker\Documents\GitHub-Local\hub-alexandria\working-files\bus-hab\bus-hab-opt-")
concat = Concatenate(FragmentA=panel, FragmentB=file_option, FragmentC=".csv")

hab_louv_dist = Number(8)
hab_dep = Number(240)
rect_h = Number(96)
rec_w = Number(72)

panel_2 = Panel("C:\Users\fharker\Documents\GitHub-Local\hub-alexandria\working-files\bus-hab\bus-hab-v3.csv")

panel_3 = Panel(concat)

pt = Point(Point(0, 0, 0))
xz = XZPlane(Origin=pt)
paramexporter = Python3Script(Export=Button(), CSV_File=panel_2)  # inputs Export: Boolean
# ---------- paramexporter: Python ----------
"""
Grasshopper CSV Parameter Exporter

Instructions:
1. Place a Python script component on your Grasshopper canvas.
2. Create two inputs on the component:
   - `Export` (Type hint: bool)
   - `CSV_File` (Type hint: str)
3. Copy and paste this script into the component.
4. Wire a Button to `Export`.
5. Wire a File Path or Panel containing the CSV path to `CSV_File`.

This script finds top-level inputs (components with no incoming wires and a custom NickName),
extracts their values or sets up reference links, and writes them to a CSV.
"""

import os
import csv
import Grasshopper as gh

def get_gh_doc():
    if 'ghenv' in globals():
        return ghenv.Component.OnPingDocument()
    if 'ghdoc' in globals():
        return ghdoc
    return None

def is_top_level(obj):
    # Check if the object is a parameter and has no incoming wires
    if isinstance(obj, gh.Kernel.IGH_Param):
        return obj.SourceCount == 0
    return False

def has_custom_nickname(obj):
    # Check if the NickName is different from the default Name
    return obj.NickName != obj.Name

def get_param_type_str(obj):
    type_name = obj.TypeName.lower()

    if "number" in type_name or "float" in type_name or "double" in type_name:
        return "float"
    elif "integer" in type_name or "int" in type_name:
        return "int"
    elif "string" in type_name or "text" in type_name:
        return "string"
    elif "boolean" in type_name or "bool" in type_name:
        return "bool"
    elif "curve" in type_name or "crv" in type_name:
        return "crv"
    elif "point" in type_name or "pt" in type_name:
        return "pt"
    elif "geometry" in type_name or "geo" in type_name:
        return "geo"
    elif "brep" in type_name:
        return "brep"
    elif "surface" in type_name or "srf" in type_name:
        return "srf"

    # Check if it's a Slider, Toggle, or Panel
    if isinstance(obj, gh.Kernel.Special.GH_NumberSlider):
        return "float" # or int based on slider type, but float is safe
    elif isinstance(obj, gh.Kernel.Special.GH_BooleanToggle):
        return "bool"
    elif isinstance(obj, gh.Kernel.Special.GH_Panel):
        return "string"

    # Default to geo for unknown types as a fallback for referenced geometry
    return "geo"

def extract_value(obj, type_str):
    # For geometry/reference types, we output the NickName as the value
    if type_str in ['crv', 'pt', 'geo', 'brep', 'srf']:
        return obj.NickName

    # For primitive types, we try to extract the value
    if isinstance(obj, gh.Kernel.Special.GH_NumberSlider):
        return str(obj.CurrentValue)
    elif isinstance(obj, gh.Kernel.Special.GH_BooleanToggle):
        return str(obj.Value)
    elif isinstance(obj, gh.Kernel.Special.GH_Panel):
        return str(obj.UserText)

    # For standard parameters, read from VolatileData or PersistentData
    if isinstance(obj, gh.Kernel.IGH_Param):
        if obj.VolatileDataCount > 0:
            first_branch = obj.VolatileData.Branches[0]
            if first_branch.Count > 0:
                # GH_Type wrappers have a Value property
                if hasattr(first_branch[0], 'Value'):
                    return str(first_branch[0].Value)
                else:
                    return str(first_branch[0])
        elif not obj.PersistentData.IsEmpty:
            first_branch = obj.PersistentData.Branches[0]
            if first_branch.Count > 0:
                if hasattr(first_branch[0], 'Value'):
                    return str(first_branch[0].Value)
                else:
                    return str(first_branch[0])

    return ""

def main():
    if 'Export' not in globals() or not Export:
        return

    if 'CSV_File' not in globals() or not CSV_File:
        print("Invalid CSV file path or CSV_File input not provided")
        return

    doc = get_gh_doc()
    if not doc:
        print("Could not find Grasshopper document context")
        return

    export_data = []
    export_data.append(["item name", "type", "value"])

    for obj in doc.Objects:
        # We look for IGH_Param (standard parameters) or Special objects (Slider, Toggle, Panel)
        is_param = isinstance(obj, gh.Kernel.IGH_Param)
        is_special = isinstance(obj, (gh.Kernel.Special.GH_NumberSlider, gh.Kernel.Special.GH_BooleanToggle, gh.Kernel.Special.GH_Panel))

        if is_param or is_special:
            if is_top_level(obj) and has_custom_nickname(obj):
                type_str = get_param_type_str(obj)
                val_str = extract_value(obj, type_str)

                name_str = obj.NickName

                # For geometry, output name as {NickName}-1
                if type_str in ['crv', 'pt', 'geo', 'brep', 'srf']:
                    name_str = "{}-1".format(name_str)

                export_data.append([name_str, type_str, val_str])

    if len(export_data) <= 1:
        print("No eligible components found to export.")
        return

    try:
        # Ensure directory exists
        dir_name = os.path.dirname(CSV_File)
        if dir_name and not os.path.exists(dir_name):
            os.makedirs(dir_name)

        with open(CSV_File, mode='w', newline='') as f:
            writer = csv.writer(f)
            writer.writerows(export_data)

        print("Successfully exported {} parameters to {}.".format(len(export_data) - 1, CSV_File))
    except Exception as e:
        print("Error writing to CSV: {}".format(e))

if __name__ == "__main__":
    main()
# ---------- end paramexporter ----------
paramcontroller = Python3Script(Update=Button(), CSV_File=panel_3)  # inputs Update: Boolean, CSV_File: String
# ---------- paramcontroller: Python ----------
"""
Grasshopper CSV Parameter Updater

Instructions:
1. Place a Python script component on your Grasshopper canvas.
2. Create two inputs on the component:
   - `Update` (Type hint: bool)
   - `CSV_File` (Type hint: str)
3. Copy and paste this script into the component.
4. Wire a Button or Boolean Toggle to `Update`.
5. Wire a File Path or Panel containing the CSV path to `CSV_File`.

The CSV must have columns: `input name`, `type`, `value`
"""

import os
import csv
import Grasshopper as gh
import System

def get_gh_doc():
    if 'ghenv' in globals():
        return ghenv.Component.OnPingDocument()
    if 'ghdoc' in globals():
        # Depending on environment, ghdoc might be the document itself
        return ghdoc
    return None

def find_param_by_nickname(doc, nickname):
    matched_params = []
    # Search for floating parameters directly on the canvas
    for obj in doc.Objects:
        if isinstance(obj, gh.Kernel.IGH_Param):
            if obj.NickName == nickname:
                matched_params.append(obj)
    return matched_params

def update_param_value(param, type_str, value_str, doc):
    type_str = type_str.lower().strip()
    value_str = value_str.strip()

    # Handle primitives
    if type_str in ['float', 'num', 'number', 'double']:
        try:
            val = float(value_str)
            param.PersistentData.Clear()
            param.PersistentData.Append(gh.Kernel.Types.GH_Number(val))
            return True
        except ValueError:
            print("Error parsing {} as float".format(value_str))

    elif type_str in ['int', 'integer']:
        try:
            val = int(value_str)
            param.PersistentData.Clear()
            param.PersistentData.Append(gh.Kernel.Types.GH_Integer(val))
            return True
        except ValueError:
            print("Error parsing {} as int".format(value_str))

    elif type_str in ['string', 'str', 'text']:
        param.PersistentData.Clear()
        param.PersistentData.Append(gh.Kernel.Types.GH_String(value_str))
        return True

    elif type_str in ['bool', 'boolean']:
        val = value_str.lower() in ['true', '1', 't', 'yes', 'y']
        param.PersistentData.Clear()
        param.PersistentData.Append(gh.Kernel.Types.GH_Boolean(val))
        return True

    # Handle reference types (geometry, etc) where value_str is the NickName of the source
    elif type_str in ['crv', 'curve', 'pt', 'point', 'geo', 'geometry', 'brep', 'srf', 'surface']:
        source_params = find_param_by_nickname(doc, value_str)
        if not source_params:
            print("Could not find source parameter with nickname '{}' on canvas".format(value_str))
            return False

        source_param = source_params[0]

        # Wire source to this param
        param.RemoveAllSources()
        param.AddSource(source_param)
        return True

    else:
        print("Unsupported type: {}".format(type_str))
        return False

# Global to store pending updates
PENDING_UPDATES = []

def schedule_callback(ghdoc):
    # This callback runs when the solution is finished and triggers a new one
    global PENDING_UPDATES

    if not PENDING_UPDATES:
        return

    updated_count = 0
    for param, type_str, value_str in PENDING_UPDATES:
        param.RecordUndoEvent("CSV Update")
        if update_param_value(param, type_str, value_str, ghdoc):
            param.ExpireSolution(False)
            updated_count += 1

    PENDING_UPDATES = []

    if updated_count > 0:
        print("Successfully updated {} parameters.".format(updated_count))
        # Start a new solution to recalculate with the new values
        ghdoc.NewSolution(False)

def main():
    global PENDING_UPDATES
    # Check inputs (which are provided as globals by the GH Python component)
    if 'Update' not in globals() or not Update:
        return

    if 'CSV_File' not in globals() or not CSV_File or not os.path.exists(CSV_File):
        print("Invalid CSV file path or CSV_File input not provided")
        return

    doc = get_gh_doc()
    if not doc:
        print("Could not find Grasshopper document context")
        return

    updated_count = 0

    # Read the CSV file
    with open(CSV_File, mode='r') as f:
        reader = csv.reader(f)
        # Handle python 2/3 next() compatibility
        try:
            headers = next(reader)
        except StopIteration:
            headers = None

        if not headers:
            print("Empty CSV file")
            return

        header_lower = [h.lower().strip() for h in headers]

        try:
            name_idx = header_lower.index("input name")
            type_idx = header_lower.index("type")
            value_idx = header_lower.index("value")
        except ValueError:
            print("Warning: Could not find exact headers 'input name', 'type', 'value'. Assuming columns 0, 1, 2.")
            name_idx, type_idx, value_idx = 0, 1, 2

        PENDING_UPDATES = []
        for row in reader:
            if len(row) <= max(name_idx, type_idx, value_idx):
                continue

            input_name = row[name_idx]
            input_type = row[type_idx]
            input_value = row[value_idx]

            target_params = find_param_by_nickname(doc, input_name)
            if not target_params:
                print("Warning: No parameter found with NickName '{}'".format(input_name))
                continue

            for param in target_params:
                PENDING_UPDATES.append((param, input_type, input_value))
                updated_count += 1

    if updated_count > 0:
        # Schedule a solution to update values outside the current solution
        delegate = gh.Kernel.GH_Document.GH_ScheduleDelegate(schedule_callback)
        doc.ScheduleSolution(5, delegate)

if __name__ == "__main__":
    main()
# ---------- end paramcontroller ----------
rectangle = Rectangle(Plane=xz, XSize=rec_w, YSize=rect_h, Radius=0)  # -> Rectangle, Length
division = Division(A=hab_dep, B=hab_louv_dist)
Y = UnitY(Factor=hab_louv_dist)
arrlinear = LinearArray(Geometry=rectangle.Rectangle, Direction=Y, Count=division)  # -> Geometry, Transform
crv = Curve(arrlinear.Geometry)
disc = Discontinuity(Curve=crv, Level=1)  # -> Points, Parameters
item = ListItem(List=disc.Points, Index=0, Wrap=True)  # -> Item, Item1, Item2, Item3
pt_2 = Point(item.Item3)
pt_3 = Point(item.Item2)
pt_4 = Point(item.Item)
pt_5 = Point(item.Item1)

pt_6 = Point(flatten(pt_5))

pt_7 = Point(flatten(pt_5))

att_top_b_z_min = Number(24)
att_top_b_pt = Number(1)
att_top_b_z_max = Number(108)
att_top_b_x_min = Number(-24)
att_top_b_x_max = Number(12)

att_bott_b_pt = Number(1)
att_bott_b_x_min = Number(-24)
att_bott_b_x_max = Number(24)
att_bott_b_z_min = Number(48)
att_bott_b_z_max = Number(80)

att_top_a_pt = Number(1)
att_top_a_x_min = Number(-24)
att_top_a_x_max = Number(24)
att_top_a_z_min = Number(-80)
att_top_a_z_max = Number(6)

pt_8 = Point(flatten(pt_2))
fline = FitLine(Points=pt_8)
eval = EvaluateCurve(Curve=reparameterize(fline), Parameter=att_top_a_pt)  # -> Point, Tangent, Angle
point_attractor = PointAttractor(A_2=eval.Point, B_2=flatten(pt_8), A=att_top_a_z_min, B=att_top_a_z_max)
Z = UnitZ(Factor=point_attractor)
move = Move(Geometry=pt_8, Motion=Z)  # -> graft(Geometry), Transform

pt_9 = Point(flatten(move.Geometry))
pt_10 = Point(pt_4)

fline_2 = FitLine(Points=pt_9)
eval_2 = EvaluateCurve(Curve=reparameterize(fline_2), Parameter=att_top_a_pt)  # -> Point, Tangent, Angle
point_attractor_2 = PointAttractor(A_2=eval_2.Point, B_2=flatten(pt_9), A=att_top_a_x_min, B=att_top_a_x_max)
X = UnitX(Factor=point_attractor_2)
move_2 = Move(Geometry=pt_9, Motion=X)  # -> graft(Geometry), Transform

fline_3 = FitLine(Points=pt_6)
eval_3 = EvaluateCurve(Curve=reparameterize(fline_3), Parameter=att_bott_b_pt)  # -> Point, Tangent, Angle
point_attractor_3 = PointAttractor(A_2=eval_3.Point, B_2=flatten(pt_6), A=att_bott_b_z_min, B=att_bott_b_z_max)
Z_2 = UnitZ(Factor=point_attractor_3)
move_3 = Move(Geometry=pt_6, Motion=Z_2)  # -> graft(Geometry), Transform

pt_11 = Point(flatten(move_3.Geometry))

fline_4 = FitLine(Points=pt_11)
eval_4 = EvaluateCurve(Curve=reparameterize(fline_4), Parameter=att_bott_b_pt)  # -> Point, Tangent, Angle
point_attractor_4 = PointAttractor(A_2=eval_4.Point, B_2=flatten(pt_11), A=att_bott_b_x_min, B=att_bott_b_x_max)
X_2 = UnitX(Factor=point_attractor_4)
move_4 = Move(Geometry=pt_11, Motion=X_2)  # -> graft(Geometry), Transform

fline_5 = FitLine(Points=pt_7)
eval_5 = EvaluateCurve(Curve=reparameterize(fline_5), Parameter=att_top_b_pt)  # -> Point, Tangent, Angle
point_attractor_5 = PointAttractor(A_2=eval_5.Point, B_2=flatten(pt_7), A=att_top_b_z_min, B=att_top_b_z_max)
Z_3 = UnitZ(Factor=point_attractor_5)
move_5 = Move(Geometry=pt_7, Motion=Z_3)  # -> graft(Geometry), Transform

pt_12 = Point(flatten(move_5.Geometry))

fline_6 = FitLine(Points=pt_12)
eval_6 = EvaluateCurve(Curve=reparameterize(fline_6), Parameter=att_top_b_pt)  # -> Point, Tangent, Angle
point_attractor_6 = PointAttractor(A_2=eval_6.Point, B_2=flatten(pt_12), A=att_top_b_x_min, B=att_top_b_x_max)
X_3 = UnitX(Factor=point_attractor_6)
move_6 = Move(Geometry=pt_12, Motion=X_3)  # -> graft(Geometry), Transform

simplify = SimplifyTree(Tree=move_4.Geometry, Front=False)
simplify_2 = SimplifyTree(Tree=move_6.Geometry, Front=False)
simplify_3 = SimplifyTree(Tree=move_2.Geometry, Front=False)
simplify_4 = SimplifyTree(Tree=pt_10, Front=False)
obj_tog = Number(1)
ln = Line(StartPoint=simplify_4, EndPoint=simplify_3)
ln_2 = Line(StartPoint=simplify_2, EndPoint=simplify)
ln_3 = Line(StartPoint=simplify_3, EndPoint=simplify_2)
onoff = EnableDisableObject(Enabled=obj_tog, AllObjects_Object=ln_2)
merge = Merge(Data1=ln, Data2=ln_3, Data3=ln_2)

louv_dim_a = Number(4)
louv_dim_b = Number(4)

join = JoinCurves(Curves=merge, Preserve=False)
offset = OffsetCurve(Curve=join, Distance=louv_dim_a, Corners=1)
edgesrf = EdgeSurface(CurveA=join, CurveB=offset)
loft = Loft(Curves=flatten(join), Options={Adjust=False, Closed=False, LoftEnds=0, LoftSimp=0, LoftType=0, Rebuild=10, Refit=0.01})
Y_2 = UnitY(Factor=louv_dim_b)
extr = Extrude(Base=edgesrf, Direction=Y_2)

# ---- group: BAKE ME!
geo = Geometry(extr)

# ==== cluster PointAttractor: Utility
A = ClusterInput()
x = ClusterInput()
A_2 = ClusterInput()
B = ClusterInput()
B_2 = ClusterInput()
dist = Distance(PointA=A_2, PointB=B_2)
dom = ConstructDomain(DomainStart=A, DomainEnd=B)
bnd = Bounds(Numbers=dist)
remap = RemapNumbers(Value=dist, Source=bnd, Target=dom)  # -> Mapped, Clipped
R = ClusterOutput(remap.Mapped)
