# Grasshopper definition bus-hab-opt-GENERAL.gh (Grasshopper 1.0.8)
# plug-ins: Pufferfish, MetaHopper

file_option = Slider(3, range=1..12)
panel = Panel("C:\Users\fharker\Documents\GitHub-Local\hub-alexandria\working-files\bus-hab\bus-hab-opt-a-")
concat = Concatenate(FragmentA=panel, FragmentB=file_option, FragmentC=".csv")

hab_louv_dist = Number(16)
hab_dep = Number(240)
rect_h = Number(96)
rec_w = Number(72)

panel_2 = Panel("C:\Users\fharker\Documents\GitHub-Local\hub-alexandria\working-files\bus-hab\bus-hab-v3.csv")  # disabled
button = Button()  # disabled

panel_3 = Panel("C:\Users\fharker\Documents\GitHub-Local\hub-alexandria\working-files\bus-hab\bus-hab-opt-GENERAL-bake.csv")  # disabled
button_2 = Button()  # disabled

panel_4 = Panel(concat)

pt = Point(Point(0, 0, 0))
xz = XZPlane(Origin=pt)
paramexporter = Python3Script(Export=button, CSV_File=panel_2)  # inputs Export: Boolean; disabled
# ---------- paramexporter: Python ----------
"""
Grasshopper CSV Parameter Exporter

Instructions:
1. Place a Python script component on your Grasshopper canvas.
2. Create two inputs on the component:
   - `Export` (Type hint: bool)
   - `CSV_File` (Type hint: str)
3. Copy and paste this script into the component.
4. Wire a Button to `Export`.
5. Wire a File Path or Panel containing the CSV path to `CSV_File`.

This script finds top-level inputs (components with no incoming wires and a custom NickName),
extracts their values or sets up reference links, and writes them to a CSV.
"""

import os
import csv
import Grasshopper as gh

def get_gh_doc():
    if 'ghenv' in globals():
        return ghenv.Component.OnPingDocument()
    if 'ghdoc' in globals():
        return ghdoc
    return None

def is_top_level(obj):
    # Check if the object is a parameter and has no incoming wires
    if isinstance(obj, gh.Kernel.IGH_Param):
        return obj.SourceCount == 0
    return False

def has_custom_nickname(obj):
    # Check if the NickName is different from the default Name
    return obj.NickName != obj.Name

def get_param_type_str(obj):
    type_name = obj.TypeName.lower()

    if "number" in type_name or "float" in type_name or "double" in type_name:
        return "float"
    elif "integer" in type_name or "int" in type_name:
        return "int"
    elif "string" in type_name or "text" in type_name:
        return "string"
    elif "boolean" in type_name or "bool" in type_name:
        return "bool"
    elif "curve" in type_name or "crv" in type_name:
        return "crv"
    elif "point" in type_name or "pt" in type_name:
        return "pt"
    elif "geometry" in type_name or "geo" in type_name:
        return "geo"
    elif "brep" in type_name:
        return "brep"
    elif "surface" in type_name or "srf" in type_name:
        return "srf"

    # Check if it's a Slider, Toggle, or Panel
    if isinstance(obj, gh.Kernel.Special.GH_NumberSlider):
        return "float" # or int based on slider type, but float is safe
    elif isinstance(obj, gh.Kernel.Special.GH_BooleanToggle):
        return "bool"
    elif isinstance(obj, gh.Kernel.Special.GH_Panel):
        return "string"

    # Default to geo for unknown types as a fallback for referenced geometry
    return "geo"

def extract_value(obj, type_str):
    # For geometry/reference types, we output the NickName as the value
    if type_str in ['crv', 'pt', 'geo', 'brep', 'srf']:
        return obj.NickName

    # For primitive types, we try to extract the value
    if isinstance(obj, gh.Kernel.Special.GH_NumberSlider):
        return str(obj.CurrentValue)
    elif isinstance(obj, gh.Kernel.Special.GH_BooleanToggle):
        return str(obj.Value)
    elif isinstance(obj, gh.Kernel.Special.GH_Panel):
        return str(obj.UserText)

    # For standard parameters, read from VolatileData or PersistentData
    if isinstance(obj, gh.Kernel.IGH_Param):
        if obj.VolatileDataCount > 0:
            first_branch = obj.VolatileData.Branches[0]
            if first_branch.Count > 0:
                # GH_Type wrappers have a Value property
                if hasattr(first_branch[0], 'Value'):
                    return str(first_branch[0].Value)
                else:
                    return str(first_branch[0])
        elif not obj.PersistentData.IsEmpty:
            first_branch = obj.PersistentData.Branches[0]
            if first_branch.Count > 0:
                if hasattr(first_branch[0], 'Value'):
                    return str(first_branch[0].Value)
                else:
                    return str(first_branch[0])

    return ""

def main():
    if 'Export' not in globals() or not Export:
        return

    if 'CSV_File' not in globals() or not CSV_File:
        print("Invalid CSV file path or CSV_File input not provided")
        return

    doc = get_gh_doc()
    if not doc:
        print("Could not find Grasshopper document context")
        return

    export_data = []
    export_data.append(["item name", "type", "value"])

    for obj in doc.Objects:
        # We look for IGH_Param (standard parameters) or Special objects (Slider, Toggle, Panel)
        is_param = isinstance(obj, gh.Kernel.IGH_Param)
        is_special = isinstance(obj, (gh.Kernel.Special.GH_NumberSlider, gh.Kernel.Special.GH_BooleanToggle, gh.Kernel.Special.GH_Panel))

        if is_param or is_special:
            if is_top_level(obj) and has_custom_nickname(obj):
                type_str = get_param_type_str(obj)
                val_str = extract_value(obj, type_str)

                name_str = obj.NickName

                # For geometry, output name as {NickName}-1
                if type_str in ['crv', 'pt', 'geo', 'brep', 'srf']:
                    name_str = "{}-1".format(name_str)

                export_data.append([name_str, type_str, val_str])

    if len(export_data) <= 1:
        print("No eligible components found to export.")
        return

    try:
        # Ensure directory exists
        dir_name = os.path.dirname(CSV_File)
        if dir_name and not os.path.exists(dir_name):
            os.makedirs(dir_name)

        with open(CSV_File, mode='w', newline='') as f:
            writer = csv.writer(f)
            writer.writerows(export_data)

        print("Successfully exported {} parameters to {}.".format(len(export_data) - 1, CSV_File))
    except Exception as e:
        print("Error writing to CSV: {}".format(e))

if __name__ == "__main__":
    main()
# ---------- end paramexporter ----------
geobaker = Python3Script(Bake=button_2, CSV_File=panel_3)  # inputs Bake: Boolean, CSV_File: String; disabled
# ---------- geobaker: Python ----------
"""
Grasshopper CSV Baker

Instructions:
1. Place a Python script component on your Grasshopper canvas.
2. Create two inputs on the component:
   - `Bake` (Type hint: bool)
   - `CSV_File` (Type hint: str)
3. Copy and paste this script into the component.
4. Wire a Button to `Bake`.
5. Wire a File Path or Panel containing the CSV path to `CSV_File`.

The CSV must have columns: `item name`, `layer`, `color`
"""

import os
import csv
import random
import Grasshopper as gh
import Rhino
import System

def get_gh_doc():
    if 'ghenv' in globals():
        return ghenv.Component.OnPingDocument()
    if 'ghdoc' in globals():
        return ghdoc
    return None

def find_params_by_nickname(gh_doc, nickname):
    matched = []
    for obj in gh_doc.Objects:
        if isinstance(obj, gh.Kernel.IGH_Param) and obj.NickName == nickname:
            matched.append(obj)
        elif isinstance(obj, gh.Kernel.IGH_Component) and obj.NickName == nickname:
            for param in obj.Params.Output:
                matched.append(param)
    return matched

def get_color_from_string(color_str, random_colors_dict):
    color_str = color_str.strip()
    if color_str.startswith('#'):
        try:
            hex_str = color_str.lstrip('#')
            if len(hex_str) == 6:
                r = int(hex_str[0:2], 16)
                g = int(hex_str[2:4], 16)
                b = int(hex_str[4:6], 16)
                return System.Drawing.Color.FromArgb(r, g, b)
            elif len(hex_str) == 3:
                r = int(hex_str[0]*2, 16)
                g = int(hex_str[1]*2, 16)
                b = int(hex_str[2]*2, 16)
                return System.Drawing.Color.FromArgb(r, g, b)
        except Exception:
            pass

    # Random color logic for string identifiers
    if color_str not in random_colors_dict:
        r = random.randint(0, 255)
        g = random.randint(0, 255)
        b = random.randint(0, 255)
        random_colors_dict[color_str] = System.Drawing.Color.FromArgb(r, g, b)

    return random_colors_dict[color_str]

def get_or_create_layer(doc, layer_path, color):
    parts = [p.strip() for p in layer_path.split('/') if p.strip()]
    if not parts:
        return None

    parent_id = System.Guid.Empty
    current_layer = None

    for part in parts:
        found = False
        for layer in doc.Layers:
            if layer.Name == part and layer.ParentLayerId == parent_id:
                current_layer = layer
                found = True
                break

        if not found:
            new_layer = Rhino.DocObjects.Layer()
            new_layer.Name = part
            new_layer.ParentLayerId = parent_id
            layer_index = doc.Layers.Add(new_layer)
            if layer_index >= 0:
                current_layer = doc.Layers[layer_index]
            else:
                return None

        parent_id = current_layer.Id

    if current_layer is not None:
        current_layer.Color = color
        doc.Layers.Modify(current_layer, current_layer.Index, True)

    return current_layer

def clear_layer_objects(doc, layer):
    objs = doc.Objects.FindByLayer(layer)
    if objs:
        for obj in objs:
            doc.Objects.Delete(obj.Id, True)

def get_geometry_from_param(param):
    geometries = []
    if hasattr(param, 'VolatileData'):
        for branch in param.VolatileData.Branches:
            for item in branch:
                val = getattr(item, 'Value', item)
                if isinstance(val, Rhino.Geometry.GeometryBase) or isinstance(val, Rhino.Geometry.Point3d) or isinstance(val, Rhino.Geometry.Line):
                    geometries.append(val)
    return geometries

def bake_geometry(doc, geometry, layer_index):
    attributes = Rhino.DocObjects.ObjectAttributes()
    attributes.LayerIndex = layer_index
    attributes.ColorSource = Rhino.DocObjects.ObjectColorSource.ColorFromLayer

    if isinstance(geometry, Rhino.Geometry.Point3d):
        doc.Objects.AddPoint(geometry, attributes)
    elif isinstance(geometry, Rhino.Geometry.Line):
        doc.Objects.AddLine(geometry, attributes)
    elif isinstance(geometry, Rhino.Geometry.Curve):
        doc.Objects.AddCurve(geometry, attributes)
    elif isinstance(geometry, Rhino.Geometry.Brep):
        doc.Objects.AddBrep(geometry, attributes)
    elif isinstance(geometry, Rhino.Geometry.Surface):
        doc.Objects.AddSurface(geometry, attributes)
    elif isinstance(geometry, Rhino.Geometry.Mesh):
        doc.Objects.AddMesh(geometry, attributes)
    elif isinstance(geometry, Rhino.Geometry.Hatch):
        doc.Objects.AddHatch(geometry, attributes)
    elif isinstance(geometry, Rhino.Geometry.TextEntity):
        doc.Objects.AddText(geometry, attributes)
    else:
        # Fallback/ignore if type is unhandled
        pass

def main():
    if 'Bake' not in globals() or not Bake:
        return

    if 'CSV_File' not in globals() or not CSV_File or not os.path.exists(CSV_File):
        print("Invalid CSV file path or CSV_File input not provided")
        return

    gh_doc = get_gh_doc()
    if not gh_doc:
        print("Could not find Grasshopper document context")
        return

    rhino_doc = Rhino.RhinoDoc.ActiveDoc
    if not rhino_doc:
        print("Could not find Active Rhino Document")
        return

    random_colors_dict = {}
    cleared_layers = set()
    baked_count = 0

    with open(CSV_File, mode='r') as f:
        reader = csv.reader(f)

        for i, row in enumerate(reader):
            # Skip header row if it exactly matches expected header names
            if i == 0 and len(row) >= 3:
                h0 = row[0].strip().lower()
                h1 = row[1].strip().lower()
                h2 = row[2].strip().lower()
                if h0 == 'item name' and h1 == 'layer' and h2 == 'color':
                    continue

            if len(row) < 3:
                continue

            item_name = row[0].strip()
            layer_path = row[1].strip()
            color_str = row[2].strip()

            if not item_name or not layer_path:
                continue

            params = find_params_by_nickname(gh_doc, item_name)
            if not params:
                continue

            all_geometries = []
            for param in params:
                all_geometries.extend(get_geometry_from_param(param))

            if not all_geometries:
                continue

            layer_color = get_color_from_string(color_str, random_colors_dict)

            layer = get_or_create_layer(rhino_doc, layer_path, layer_color)
            if not layer:
                print("Failed to get or create layer: {}".format(layer_path))
                continue

            if layer.Id not in cleared_layers:
                clear_layer_objects(rhino_doc, layer)
                cleared_layers.add(layer.Id)

            for geo in all_geometries:
                bake_geometry(rhino_doc, geo, layer.Index)
                baked_count += 1

    if baked_count > 0:
        print("Successfully baked {} geometries to layers.".format(baked_count))

if __name__ == "__main__":
    main()
# ---------- end geobaker ----------
paramcontroller = Python3Script(Update=Button(), CSV_File=panel_4)  # inputs Update: Boolean, CSV_File: String
# ---------- paramcontroller: Python ----------
"""
Grasshopper CSV Parameter Updater

Instructions:
1. Place a Python script component on your Grasshopper canvas.
2. Create two inputs on the component:
   - `Update` (Type hint: bool)
   - `CSV_File` (Type hint: str)
3. Copy and paste this script into the component.
4. Wire a Button or Boolean Toggle to `Update`.
5. Wire a File Path or Panel containing the CSV path to `CSV_File`.

The CSV must have columns: `input name`, `type`, `value`
"""

import os
import csv
import Grasshopper as gh
import System

def get_gh_doc():
    if 'ghenv' in globals():
        return ghenv.Component.OnPingDocument()
    if 'ghdoc' in globals():
        # Depending on environment, ghdoc might be the document itself
        return ghdoc
    return None

def find_param_by_nickname(doc, nickname):
    matched_params = []
    # Search for floating parameters directly on the canvas
    for obj in doc.Objects:
        if isinstance(obj, gh.Kernel.IGH_Param):
            if obj.NickName == nickname:
                matched_params.append(obj)
    return matched_params

def update_param_value(param, type_str, value_str, doc):
    type_str = type_str.lower().strip()
    value_str = value_str.strip()

    # Handle primitives
    if type_str in ['float', 'num', 'number', 'double']:
        try:
            val = float(value_str)
            param.PersistentData.Clear()
            param.PersistentData.Append(gh.Kernel.Types.GH_Number(val))
            return True
        except ValueError:
            print("Error parsing {} as float".format(value_str))

    elif type_str in ['int', 'integer']:
        try:
            val = int(value_str)
            param.PersistentData.Clear()
            param.PersistentData.Append(gh.Kernel.Types.GH_Integer(val))
            return True
        except ValueError:
            print("Error parsing {} as int".format(value_str))

    elif type_str in ['string', 'str', 'text']:
        param.PersistentData.Clear()
        param.PersistentData.Append(gh.Kernel.Types.GH_String(value_str))
        return True

    elif type_str in ['bool', 'boolean']:
        val = value_str.lower() in ['true', '1', 't', 'yes', 'y']
        param.PersistentData.Clear()
        param.PersistentData.Append(gh.Kernel.Types.GH_Boolean(val))
        return True

    # Handle reference types (geometry, etc) where value_str is the NickName of the source
    elif type_str in ['crv', 'curve', 'pt', 'point', 'geo', 'geometry', 'brep', 'srf', 'surface']:
        source_params = find_param_by_nickname(doc, value_str)
        if not source_params:
            print("Could not find source parameter with nickname '{}' on canvas".format(value_str))
            return False

        source_param = source_params[0]

        # Wire source to this param
        param.RemoveAllSources()
        param.AddSource(source_param)
        return True

    else:
        print("Unsupported type: {}".format(type_str))
        return False

# Global to store pending updates
PENDING_UPDATES = []

def schedule_callback(ghdoc):
    # This callback runs when the solution is finished and triggers a new one
    global PENDING_UPDATES

    if not PENDING_UPDATES:
        return

    updated_count = 0
    for param, type_str, value_str in PENDING_UPDATES:
        param.RecordUndoEvent("CSV Update")
        if update_param_value(param, type_str, value_str, ghdoc):
            param.ExpireSolution(False)
            updated_count += 1

    PENDING_UPDATES = []

    if updated_count > 0:
        print("Successfully updated {} parameters.".format(updated_count))
        # Start a new solution to recalculate with the new values
        ghdoc.NewSolution(False)

def main():
    global PENDING_UPDATES
    # Check inputs (which are provided as globals by the GH Python component)
    if 'Update' not in globals() or not Update:
        return

    if 'CSV_File' not in globals() or not CSV_File or not os.path.exists(CSV_File):
        print("Invalid CSV file path or CSV_File input not provided")
        return

    doc = get_gh_doc()
    if not doc:
        print("Could not find Grasshopper document context")
        return

    updated_count = 0

    # Read the CSV file
    with open(CSV_File, mode='r') as f:
        reader = csv.reader(f)
        # Handle python 2/3 next() compatibility
        try:
            headers = next(reader)
        except StopIteration:
            headers = None

        if not headers:
            print("Empty CSV file")
            return

        header_lower = [h.lower().strip() for h in headers]

        try:
            name_idx = header_lower.index("input name")
            type_idx = header_lower.index("type")
            value_idx = header_lower.index("value")
        except ValueError:
            print("Warning: Could not find exact headers 'input name', 'type', 'value'. Assuming columns 0, 1, 2.")
            name_idx, type_idx, value_idx = 0, 1, 2

        PENDING_UPDATES = []
        for row in reader:
            if len(row) <= max(name_idx, type_idx, value_idx):
                continue

            input_name = row[name_idx]
            input_type = row[type_idx]
            input_value = row[value_idx]

            target_params = find_param_by_nickname(doc, input_name)
            if not target_params:
                print("Warning: No parameter found with NickName '{}'".format(input_name))
                continue

            for param in target_params:
                PENDING_UPDATES.append((param, input_type, input_value))
                updated_count += 1

    if updated_count > 0:
        # Schedule a solution to update values outside the current solution
        delegate = gh.Kernel.GH_Document.GH_ScheduleDelegate(schedule_callback)
        doc.ScheduleSolution(5, delegate)

if __name__ == "__main__":
    main()
# ---------- end paramcontroller ----------
rectangle = Rectangle(Plane=xz, XSize=rec_w, YSize=rect_h, Radius=0)  # -> Rectangle, Length
division = Division(A=hab_dep, B=hab_louv_dist)
Y = UnitY(Factor=hab_louv_dist)
arrlinear = LinearArray(Geometry=rectangle.Rectangle, Direction=Y, Count=division)  # -> Geometry, Transform
crv = Curve(arrlinear.Geometry)
disc = Discontinuity(Curve=crv, Level=1)  # -> Points, Parameters
item = ListItem(List=disc.Points, Index=0, Wrap=True)  # -> Item, Item1, Item2, Item3
pt_2 = Point(item.Item2)
pt_3 = Point(item.Item3)
pt_4 = Point(item.Item1)
pt_5 = Point(item.Item)

pt_6 = Point(flatten(pt_4))

pt_7 = Point(flatten(pt_4))

att_bott_b_pt = Number(1)
att_bott_b_x_min = Number(-24)
att_bott_b_x_max = Number(24)
att_bott_b_z_min = Number(72)
att_bott_b_z_max = Number(102)

att_top_b_pt = Number(1)
att_top_b_z_min = Number(24)
att_top_b_z_max = Number(108)
att_top_b_x_min = Number(-24)
att_top_b_x_max = Number(12)

pt_8 = Point(pt_5)

att_top_a_pt = Number(1)
att_top_a_x_min = Number(-32)
att_top_a_x_max = Number(12)
att_top_a_z_min = Number(-72)
att_top_a_z_max = Number(18)

pt_9 = Point(flatten(pt_3))
fline = FitLine(Points=pt_9)
eval = EvaluateCurve(Curve=reparameterize(fline), Parameter=att_top_a_pt)  # -> Point, Tangent, Angle
point_attractor = PointAttractor(A_2=eval.Point, B_2=flatten(pt_9), A=att_top_a_z_min, B=att_top_a_z_max)  # -> R, I, normalized
Z = UnitZ(Factor=point_attractor.R)
move = Move(Geometry=pt_9, Motion=Z)  # -> graft(Geometry), Transform

pt_10 = Point(flatten(move.Geometry))

fline_2 = FitLine(Points=pt_10)
eval_2 = EvaluateCurve(Curve=reparameterize(fline_2), Parameter=att_top_a_pt)  # -> Point, Tangent, Angle
point_attractor_2 = PointAttractor(A_2=eval_2.Point, B_2=flatten(pt_10), A=att_top_a_x_min, B=att_top_a_x_max)  # -> R, I, normalized
X = UnitX(Factor=point_attractor_2.R)
move_2 = Move(Geometry=pt_10, Motion=X)  # -> graft(Geometry), Transform

fline_3 = FitLine(Points=pt_7)
eval_3 = EvaluateCurve(Curve=reparameterize(fline_3), Parameter=att_bott_b_pt)  # -> Point, Tangent, Angle
point_attractor_3 = PointAttractor(A_2=eval_3.Point, B_2=flatten(pt_7), A=att_bott_b_z_min, B=att_bott_b_z_max)  # -> R, I, normalized
Z_2 = UnitZ(Factor=point_attractor_3.R)
move_3 = Move(Geometry=pt_7, Motion=Z_2)  # -> graft(Geometry), Transform

pt_11 = Point(flatten(move_3.Geometry))

fline_4 = FitLine(Points=pt_11)
eval_4 = EvaluateCurve(Curve=reparameterize(fline_4), Parameter=att_bott_b_pt)  # -> Point, Tangent, Angle
point_attractor_4 = PointAttractor(A_2=eval_4.Point, B_2=flatten(pt_11), A=att_bott_b_x_min, B=att_bott_b_x_max)  # -> R, I, normalized
X_2 = UnitX(Factor=point_attractor_4.R)
move_4 = Move(Geometry=pt_11, Motion=X_2)  # -> graft(Geometry), Transform

dom = ConstructDomain(DomainStart=att_top_b_z_min, DomainEnd=att_top_b_z_max)
bnd = Bounds()
dom_2 = ConstructDomain(DomainStart=0, DomainEnd=1)
remap = RemapNumbers(Source=bnd, Target=dom_2)  # -> Mapped, Clipped
bnd_2 = Bounds()
dom_3 = ConstructDomain(DomainStart=0, DomainEnd=1)
graph = GraphMapper(remap.Mapped, x0=0, x1=1, y0=0, y1=1, Cx=0.6542190313, Cy=0.1885048747, container_name="Conic")
remap_2 = RemapNumbers(Source=bnd_2, Target=dom_3)  # -> Mapped, Clipped
bnd_3 = Bounds(Numbers=graph)
graph_2 = GraphMapper(remap_2.Mapped, x0=0, x1=1, y0=0, y1=1, Cx=0.3279834688, Cy=0.6703500152, container_name="Conic")
remap_3 = RemapNumbers(Value=graph, Source=bnd_3, Target=dom)  # -> Mapped, Clipped
bnd_4 = Bounds(Numbers=graph_2)
remap_4 = RemapNumbers(Value=graph_2, Source=bnd_4, Target=dom)  # -> Mapped, Clipped

fline_5 = FitLine(Points=pt_6)
eval_5 = EvaluateCurve(Curve=reparameterize(fline_5), Parameter=att_top_b_pt)  # -> Point, Tangent, Angle
Z_3 = UnitZ(Factor=remap_4.Mapped)
move_5 = Move(Geometry=pt_6, Motion=Z_3)  # -> graft(Geometry), Transform

pt_12 = Point(flatten(move_5.Geometry))

fline_6 = FitLine(Points=pt_12)
eval_6 = EvaluateCurve(Curve=reparameterize(fline_6), Parameter=att_top_b_pt)  # -> Point, Tangent, Angle
point_attractor_5 = PointAttractor(A_2=eval_6.Point, B_2=flatten(pt_12), A=att_top_b_x_min, B=att_top_b_x_max)  # -> R, I, normalized
X_3 = UnitX(Factor=remap_3.Mapped)
move_6 = Move(Geometry=pt_12, Motion=X_3)  # -> graft(Geometry), Transform

dist = Distance(PointA=eval_5.Point, PointB=pt_6)
point_attractor_6 = PointAttractor(A_2=eval_5.Point, B_2=flatten(pt_6), A=att_top_b_z_min, B=att_top_b_z_max)  # -> R, I, normalized
bnd_5 = Bounds(Numbers=dist)
simplify = SimplifyTree(Tree=move_4.Geometry, Front=False)
simplify_2 = SimplifyTree(Tree=move_6.Geometry, Front=False)
simplify_3 = SimplifyTree(Tree=move_2.Geometry, Front=False)
simplify_4 = SimplifyTree(Tree=pt_8, Front=False)
obj_tog = Number(0)
ln = Line(StartPoint=simplify_4, EndPoint=simplify_3)
ln_2 = Line(StartPoint=simplify_2, EndPoint=simplify)
ln_3 = Line(StartPoint=simplify_3, EndPoint=simplify_2)
onoff = EnableDisableObject(Enabled=obj_tog, AllObjects_Object=[simplify_18, ln_18])
merge = Merge(Data1=ln, Data2=ln_3, Data3=ln_2)

louv_dim_b = Number(4)
louv_dim_a = Number(4)

join = JoinCurves(Curves=merge, Preserve=False)
offset = OffsetCurve(Curve=join, Distance=louv_dim_a, Corners=1)
edgesrf = EdgeSurface(CurveA=join, CurveB=offset)
loft = Loft(Curves=flatten(join), Options={Adjust=False, Closed=False, LoftEnds=0, LoftSimp=0, LoftType=0, Rebuild=10, Refit=0.01})
Y_2 = UnitY(Factor=louv_dim_b)
extr = Extrude(Base=edgesrf, Direction=Y_2)
objbynn = GetObjectByNickname()

# ---- group: BAKE ME!
geo = Geometry(extr)

# ----
file_option_2 = Slider(3, range=1..12)
file_option_3 = Slider(3, range=1..12)
file_option_4 = Slider(1, range=1..100)
panel_5 = Panel("C:\Users\fharker\Documents\GitHub-Local\hub-alexandria\working-files\bus-hab\bus-hab-opt-a-")
panel_6 = Panel("C:\Users\fharker\Documents\GitHub-Local\hub-alexandria\working-files\bus-hab\bus-hab-opt-a-")
panel_7 = Panel("C:\Users\fharker\Documents\GitHub-Local\hub-alexandria\working-files\bus-hab\bus-hab-opt-b-")
concat_2 = Concatenate(FragmentA=panel_5, FragmentB=file_option_2, FragmentC=".csv")
concat_3 = Concatenate(FragmentA=panel_6, FragmentB=file_option_3, FragmentC=".csv")
concat_4 = Concatenate(FragmentA=panel_7, FragmentB=file_option_4, FragmentC=".csv")

hab_louv_dist_2 = Number(16)
hab_dep_2 = Number(240)
rect_h_2 = Number(96)
rec_w_2 = Number(72)

hab_louv_dist_3 = Number(16)
hab_dep_3 = Number(240)
rect_h_3 = Number(96)
rec_w_3 = Number(72)

panel_8 = Panel("C:\Users\fharker\Documents\GitHub-Local\hub-alexandria\working-files\bus-hab\bus-hab-v3.csv")  # disabled
button_3 = Button()  # disabled

panel_9 = Panel("C:\Users\fharker\Documents\GitHub-Local\hub-alexandria\working-files\bus-hab\bus-hab-opt-GENERAL-bake.csv")  # disabled
button_4 = Button()  # disabled

panel_10 = Panel(concat_2)

hab_louv_dist_4 = Number(16)
hab_dep_4 = Number(240)
rect_h_4 = Number(96)
rec_w_4 = Number(72)

panel_11 = Panel("C:\Users\fharker\Documents\GitHub-Local\hub-alexandria\working-files\bus-hab\bus-hab-v3.csv")  # disabled
button_5 = Button()  # disabled

panel_12 = Panel("C:\Users\fharker\Documents\GitHub-Local\hub-alexandria\working-files\bus-hab\bus-hab-opt-GENERAL-bake.csv")  # disabled
button_6 = Button()  # disabled

panel_13 = Panel(concat_3)

hab_louv_dist_5 = Number(16)
hab_dep_5 = Number(240)
rect_h_5 = Number(96)
rec_w_5 = Number(72)

panel_14 = Panel("C:\Users\fharker\Documents\GitHub-Local\hub-alexandria\working-files\bus-hab\bus-hab-v3.csv")  # disabled
button_7 = Button()  # disabled

hab_louv_dist_6 = Number(16)
hab_dep_6 = Number(240)
rect_h_6 = Number(96)
rec_w_6 = Number(72)

panel_15 = Panel("C:\Users\fharker\Documents\GitHub-Local\hub-alexandria\working-files\bus-hab\bus-hab-opt-GENERAL-bake.csv")  # disabled
button_8 = Button()  # disabled

panel_16 = Panel("C:\Users\fharker\Documents\GitHub-Local\hub-alexandria\working-files\bus-hab\bus-hab-v3.csv")

panel_17 = Panel("C:\Users\fharker\Documents\GitHub-Local\hub-alexandria\working-files\bus-hab\bus-hab-v3.csv")

panel_18 = Panel(concat_4)

pt_13 = Point(Point(0, 0, 0))
pt_14 = Point(Point(0, 0, 0))
pt_15 = Point(Point(0, 0, 0))
xz_2 = XZPlane(Origin=pt_13)
xz_3 = XZPlane(Origin=pt_14)
xz_4 = XZPlane(Origin=pt_15)
paramexporter_2 = Python3Script(Export=button_3, CSV_File=panel_8)  # inputs Export: Boolean; disabled; same code as paramexporter
geobaker_2 = Python3Script(Bake=button_4, CSV_File=panel_9)  # inputs Bake: Boolean, CSV_File: String; disabled; same code as geobaker
paramcontroller_2 = Python3Script(Update=Button(), CSV_File=panel_10)  # inputs Update: Boolean, CSV_File: String; same code as paramcontroller
paramexporter_3 = Python3Script(Export=button_5, CSV_File=panel_11)  # inputs Export: Boolean; disabled; same code as paramexporter
geobaker_3 = Python3Script(Bake=button_6, CSV_File=panel_12)  # inputs Bake: Boolean, CSV_File: String; disabled; same code as geobaker
paramcontroller_3 = Python3Script(Update=Button(), CSV_File=panel_13)  # inputs Update: Boolean, CSV_File: String; same code as paramcontroller
rectangle_2 = Rectangle(Plane=xz_2, XSize=rec_w_2, YSize=rect_h_2, Radius=0)  # -> Rectangle, Length
rectangle_3 = Rectangle(Plane=xz_3, XSize=rec_w_3, YSize=rect_h_3, Radius=0)  # -> Rectangle, Length
paramexporter_4 = Python3Script(Export=Button(), CSV_File=panel_17)  # inputs Export: Boolean; same code as paramexporter
paramcontroller_4 = Python3Script(Update=Button(), CSV_File=panel_18)  # inputs Update: Boolean, CSV_File: String; same code as paramcontroller
division_2 = Division(A=hab_dep_2, B=hab_louv_dist_2)
rectangle_4 = Rectangle(Plane=xz_4, XSize=rec_w_6, YSize=rect_h_6, Radius=0)  # -> Rectangle, Length
division_3 = Division(A=hab_dep_3, B=hab_louv_dist_3)
division_4 = Division(A=hab_dep_6, B=hab_louv_dist_6)
Y_3 = UnitY(Factor=hab_louv_dist_2)
Y_4 = UnitY(Factor=hab_louv_dist_3)
Y_5 = UnitY(Factor=hab_louv_dist_6)
arrlinear_2 = LinearArray(Geometry=rectangle_2.Rectangle, Direction=Y_3, Count=division_2)  # -> Geometry, Transform
arrlinear_3 = LinearArray(Geometry=rectangle_3.Rectangle, Direction=Y_4, Count=division_3)  # -> Geometry, Transform
arrlinear_4 = LinearArray(Geometry=rectangle_4.Rectangle, Direction=Y_5, Count=division_4)  # -> Geometry, Transform
crv_2 = Curve(arrlinear_2.Geometry)
crv_3 = Curve(arrlinear_3.Geometry)
crv_4 = Curve(arrlinear_4.Geometry)
disc_2 = Discontinuity(Curve=crv_2, Level=1)  # -> Points, Parameters
lastdex = LastIndex(List=crv_4)
disc_3 = Discontinuity(Curve=crv_3, Level=1)  # -> Points, Parameters
item_2 = ListItem(List=disc_2.Points, Index=0, Wrap=True)  # -> Item, Item1, Item2, Item3
item_3 = ListItem(List=disc_3.Points, Index=0, Wrap=True)  # -> Item, Item1, Item2, Item3
item_4 = ListItem(List=crv_4, Index=Slider(0, range=0..100), Wrap=True)
item_5 = ListItem(List=crv_4, Index=lastdex, Wrap=True)
pt_16 = Point(item_2.Item3)
pt_17 = Point(item_2.Item2)
pt_18 = Point(item_2.Item)
pt_19 = Point(item_2.Item1)
pt_20 = Point(item_3.Item3)
pt_21 = Point(item_3.Item2)
pt_22 = Point(item_3.Item)
pt_23 = Point(item_3.Item1)
disc_4 = Discontinuity(Curve=item_4, Level=1)  # -> Points, Parameters
disc_5 = Discontinuity(Curve=item_5, Level=1)  # -> Points, Parameters
item_6 = ListItem(List=disc_4.Points, Index=0, Wrap=True)  # -> Item, Item1, Item2, Item3
item_7 = ListItem(List=disc_5.Points, Index=0, Wrap=True)  # -> Item, Item1, Item2, Item3
pt_24 = Point(item_6.Item)
pt_25 = Point(item_6.Item3)
pt_26 = Point(item_6.Item2)
pt_27 = Point(item_6.Item1)
pt_28 = Point(item_7.Item)
pt_29 = Point(item_7.Item3)
pt_30 = Point(item_7.Item2)
pt_31 = Point(item_7.Item1)
start_top_front_x_a = Number(-60)
start_top_front_z_a = Number(-12)
start_top_front_x_b = Number(-12)
end_top_front_x_a = Number(-30)
start_top_front_z_b = Number(-24)
end_top_front_z_a = Number(12)
end_top_front_x_b = Number(12)
end_top_front_z_b = Number(-12)
start_top_back_x = Number(-12)
start_top_back_z = Number(-48)
end_top_back_z = Number(12)
end_top_back_x = Number(-48)
Z_4 = UnitZ(Factor=start_top_front_z_a)
Z_5 = UnitZ(Factor=start_top_front_z_b)
X_4 = UnitX(Factor=start_top_front_x_a)
Z_6 = UnitZ(Factor=end_top_front_z_a)
X_5 = UnitX(Factor=start_top_front_x_b)
Z_7 = UnitZ(Factor=end_top_front_z_b)
X_6 = UnitX(Factor=end_top_front_x_a)
Z_8 = UnitZ(Factor=start_top_back_z)
X_7 = UnitX(Factor=end_top_front_x_b)
X_8 = UnitX(Factor=start_top_back_x)
Z_9 = UnitZ(Factor=end_top_back_z)
X_9 = UnitX(Factor=end_top_back_x)

pt_32 = Point(flatten(pt_19))

pt_33 = Point(flatten(pt_23))

move_7 = Move(Geometry=pt_26, Motion=Z_4)  # -> Geometry, Transform

pt_34 = Point(flatten(pt_19))

move_8 = Move(Geometry=pt_26, Motion=Z_5)  # -> Geometry, Transform
move_9 = Move(Geometry=pt_30, Motion=Z_6)  # -> Geometry, Transform

pt_35 = Point(flatten(pt_23))

move_10 = Move(Geometry=pt_30, Motion=Z_7)  # -> Geometry, Transform
move_11 = Move(Geometry=pt_25, Motion=Z_8)  # -> Geometry, Transform
move_12 = Move(Geometry=pt_29, Motion=Z_9)  # -> Geometry, Transform

att_bott_b_pt_2 = Number(1)
att_bott_b_x_min_2 = Number(-24)
att_bott_b_x_max_2 = Number(24)
att_bott_b_z_min_2 = Number(72)
att_bott_b_z_max_2 = Number(102)

att_bott_b_pt_3 = Number(1)
att_bott_b_x_min_3 = Number(-24)
att_bott_b_x_max_3 = Number(24)
att_bott_b_z_min_3 = Number(72)
att_bott_b_z_max_3 = Number(102)

att_bott_b_pt_4 = Number(1)
att_bott_b_x_min_4 = Number(-24)
att_bott_b_x_max_4 = Number(24)
att_bott_b_z_min_4 = Number(72)
att_bott_b_z_max_4 = Number(102)

move_13 = Move(Geometry=move_12.Geometry, Motion=X_9)  # -> Geometry, Transform
move_14 = Move(Geometry=move_11.Geometry, Motion=X_8)  # -> Geometry, Transform
move_15 = Move(Geometry=move_7.Geometry, Motion=X_4)  # -> Geometry, Transform
move_16 = Move(Geometry=move_8.Geometry, Motion=X_5)  # -> Geometry, Transform
move_17 = Move(Geometry=move_9.Geometry, Motion=X_6)  # -> Geometry, Transform
move_18 = Move(Geometry=move_10.Geometry, Motion=X_7)  # -> Geometry, Transform

att_top_b_z_min_2 = Number(24)
att_top_b_pt_2 = Number(1)
att_top_b_z_max_2 = Number(108)
att_top_b_x_min_2 = Number(-24)
att_top_b_x_max_2 = Number(12)

att_top_a_pt_2 = Number(1)
att_top_a_x_min_2 = Number(-32)
att_top_a_x_max_2 = Number(12)
att_top_a_z_min_2 = Number(-72)
att_top_a_z_max_2 = Number(18)

pt_36 = Point(flatten(pt_16))
fline_7 = FitLine(Points=pt_36)
eval_7 = EvaluateCurve(Curve=reparameterize(fline_7), Parameter=att_top_a_pt_2)  # -> Point, Tangent, Angle
point_attractor_7 = PointAttractor(A_2=eval_7.Point, B_2=flatten(pt_36), A=att_top_a_z_min_2, B=att_top_a_z_max_2)  # -> R, I, normalized
Z_10 = UnitZ(Factor=point_attractor_7.R)
move_19 = Move(Geometry=pt_36, Motion=Z_10)  # -> graft(Geometry), Transform

pt_37 = Point(flatten(move_19.Geometry))

att_top_b_z_min_3 = Number(24)
att_top_b_pt_3 = Number(1)
att_top_b_z_max_3 = Number(108)
att_top_b_x_min_3 = Number(-24)
att_top_b_x_max_3 = Number(12)

att_top_a_pt_3 = Number(1)
att_top_a_x_min_3 = Number(-32)
att_top_a_x_max_3 = Number(12)
att_top_a_z_min_3 = Number(-72)
att_top_a_z_max_3 = Number(18)

pt_38 = Point(flatten(pt_20))
fline_8 = FitLine(Points=pt_38)
eval_8 = EvaluateCurve(Curve=reparameterize(fline_8), Parameter=att_top_a_pt_3)  # -> Point, Tangent, Angle
point_attractor_8 = PointAttractor(A_2=eval_8.Point, B_2=flatten(pt_38), A=att_top_a_z_min_3, B=att_top_a_z_max_3)  # -> R, I, normalized
Z_11 = UnitZ(Factor=point_attractor_8.R)
move_20 = Move(Geometry=pt_38, Motion=Z_11)  # -> graft(Geometry), Transform

pt_39 = Point(flatten(move_20.Geometry))
pt_40 = Point(pt_18)

att_top_b_z_min_4 = Number(24)
att_top_b_pt_4 = Number(1)
att_top_b_z_max_4 = Number(108)
att_top_b_x_min_4 = Number(-24)
att_top_b_x_max_4 = Number(12)

att_top_a_pt_4 = Number(1)
att_top_a_x_min_4 = Number(-32)
att_top_a_x_max_4 = Number(12)
att_top_a_z_min_4 = Number(-72)
att_top_a_z_max_4 = Number(18)

pt_41 = Point(pt_22)

att_top_b_z_min_5 = Number(24)
att_top_b_pt_5 = Number(1)
att_top_b_z_max_5 = Number(108)
att_top_b_x_min_5 = Number(-24)
att_top_b_x_max_5 = Number(12)

att_bott_b_pt_5 = Number(1)
att_bott_b_x_min_5 = Number(-24)
att_bott_b_x_max_5 = Number(24)
att_bott_b_z_min_5 = Number(72)
att_bott_b_z_max_5 = Number(102)

att_top_a_pt_5 = Number(1)
att_top_a_x_min_5 = Number(-32)
att_top_a_x_max_5 = Number(12)
att_top_a_z_min_5 = Number(-72)
att_top_a_z_max_5 = Number(18)

fline_9 = FitLine(Points=pt_37)
eval_9 = EvaluateCurve(Curve=reparameterize(fline_9), Parameter=att_top_a_pt_2)  # -> Point, Tangent, Angle
point_attractor_9 = PointAttractor(A_2=eval_9.Point, B_2=flatten(pt_37), A=att_top_a_x_min_2, B=att_top_a_x_max_2)  # -> R, I, normalized
X_10 = UnitX(Factor=point_attractor_9.R)
move_21 = Move(Geometry=pt_37, Motion=X_10)  # -> graft(Geometry), Transform

fline_10 = FitLine(Points=pt_39)
eval_10 = EvaluateCurve(Curve=reparameterize(fline_10), Parameter=att_top_a_pt_3)  # -> Point, Tangent, Angle
point_attractor_10 = PointAttractor(A_2=eval_10.Point, B_2=flatten(pt_39), A=att_top_a_x_min_3, B=att_top_a_x_max_3)  # -> R, I, normalized
X_11 = UnitX(Factor=point_attractor_10.R)
move_22 = Move(Geometry=pt_39, Motion=X_11)  # -> graft(Geometry), Transform

fline_11 = FitLine(Points=pt_32)
eval_11 = EvaluateCurve(Curve=reparameterize(fline_11), Parameter=att_bott_b_pt_2)  # -> Point, Tangent, Angle
point_attractor_11 = PointAttractor(A_2=eval_11.Point, B_2=flatten(pt_32), A=att_bott_b_z_min_2, B=att_bott_b_z_max_2)  # -> R, I, normalized
Z_12 = UnitZ(Factor=point_attractor_11.R)
move_23 = Move(Geometry=pt_32, Motion=Z_12)  # -> graft(Geometry), Transform

pt_42 = Point(flatten(move_23.Geometry))

fline_12 = FitLine(Points=pt_42)
eval_12 = EvaluateCurve(Curve=reparameterize(fline_12), Parameter=att_bott_b_pt_2)  # -> Point, Tangent, Angle
point_attractor_12 = PointAttractor(A_2=eval_12.Point, B_2=flatten(pt_42), A=att_bott_b_x_min_2, B=att_bott_b_x_max_2)  # -> R, I, normalized
X_12 = UnitX(Factor=point_attractor_12.R)
move_24 = Move(Geometry=pt_42, Motion=X_12)  # -> graft(Geometry), Transform

fline_13 = FitLine(Points=pt_33)
eval_13 = EvaluateCurve(Curve=reparameterize(fline_13), Parameter=att_bott_b_pt_3)  # -> Point, Tangent, Angle
point_attractor_13 = PointAttractor(A_2=eval_13.Point, B_2=flatten(pt_33), A=att_bott_b_z_min_3, B=att_bott_b_z_max_3)  # -> R, I, normalized
Z_13 = UnitZ(Factor=point_attractor_13.R)
move_25 = Move(Geometry=pt_33, Motion=Z_13)  # -> graft(Geometry), Transform

pt_43 = Point(flatten(move_25.Geometry))

fline_14 = FitLine(Points=pt_43)
eval_14 = EvaluateCurve(Curve=reparameterize(fline_14), Parameter=att_bott_b_pt_3)  # -> Point, Tangent, Angle
point_attractor_14 = PointAttractor(A_2=eval_14.Point, B_2=flatten(pt_43), A=att_bott_b_x_min_3, B=att_bott_b_x_max_3)  # -> R, I, normalized
X_13 = UnitX(Factor=point_attractor_14.R)
move_26 = Move(Geometry=pt_43, Motion=X_13)  # -> graft(Geometry), Transform

fline_15 = FitLine(Points=pt_34)
eval_15 = EvaluateCurve(Curve=reparameterize(fline_15), Parameter=att_top_b_pt_2)  # -> Point, Tangent, Angle
point_attractor_15 = PointAttractor(A_2=eval_15.Point, B_2=flatten(pt_34), A=att_top_b_z_min_2, B=att_top_b_z_max_2)  # -> R, I, normalized
Z_14 = UnitZ(Factor=point_attractor_15.R)
move_27 = Move(Geometry=pt_34, Motion=Z_14)  # -> graft(Geometry), Transform

pt_44 = Point(flatten(move_27.Geometry))

fline_16 = FitLine(Points=pt_44)
eval_16 = EvaluateCurve(Curve=reparameterize(fline_16), Parameter=att_top_b_pt_2)  # -> Point, Tangent, Angle
point_attractor_16 = PointAttractor(A_2=eval_16.Point, B_2=flatten(pt_44), A=att_top_b_x_min_2, B=att_top_b_x_max_2)  # -> R, I, normalized
X_14 = UnitX(Factor=point_attractor_16.R)
move_28 = Move(Geometry=pt_44, Motion=X_14)  # -> graft(Geometry), Transform

ln_4 = Line(StartPoint=move_14.Geometry, EndPoint=move_15.Geometry)
ln_5 = Line(StartPoint=pt_24, EndPoint=move_14.Geometry)
ln_6 = Line(StartPoint=pt_28, EndPoint=move_13.Geometry)
ln_7 = Line(StartPoint=move_13.Geometry, EndPoint=move_17.Geometry)
third_togg = Number(1)
ln_8 = Line(StartPoint=move_15.Geometry, EndPoint=move_16.Geometry)
ln_9 = Line(StartPoint=move_17.Geometry, EndPoint=move_18.Geometry)
onoff_2 = EnableDisableObject(Enabled=third_togg, AllObjects_Object=[ln_8, ln_9])
merge_2 = Merge(Data1=ln_5, Data2=ln_4, Data3=ln_8)
merge_3 = Merge(Data1=ln_6, Data2=ln_7, Data3=ln_9)
join_2 = JoinCurves(Curves=merge_3, Preserve=False)
join_3 = JoinCurves(Curves=merge_2, Preserve=False)
merge_4 = Merge(Data1=join_3, Data2=join_2)
bnd_6 = Bounds()
reb = RebuildCurve(Curve=join_2, Degree=Slider(6, range=0..100), Count=Slider(26, range=0..100), Tangents=False)
loft_2 = Loft(Curves=merge_4, Options={Adjust=False, Closed=False, LoftEnds=0, LoftSimp=0, LoftType=0, Rebuild=10, Refit=0.01})
py3 = Python3Script()  # -> out, a; inputs Points: list of Point3dList, Surface: Surface
# ---------- py3: Python ----------
"""GhPython Component
Inputs:
    Points:  List[Rhino.Geometry.Point3d] (section locations; typically y=0)
    Surface: Rhino surface or brep to contour

Outputs:
    Curves:  List[Rhino.Geometry.Curve] resulting from cutting with YZ planes at each unique X
"""

import Rhino
import scriptcontext as sc
from Rhino.Geometry import Point3d, Plane, Brep

# --- Helpers ---------------------------------------------------------------

def get_model_tol(default=0.01):
    try:
        if sc.doc and hasattr(sc.doc, "ModelAbsoluteTolerance"):
            return sc.doc.ModelAbsoluteTolerance
        if Rhino.RhinoDoc.ActiveDoc:
            return Rhino.RhinoDoc.ActiveDoc.ModelAbsoluteTolerance
    except:
        pass
    return default

def to_brep(geo):
    """Accept Brep or Surface; return Brep or None."""
    if isinstance(geo, Brep):
        return geo
    # Surfaces in GH often come in as Rhino.Geometry.Surface or BrepFace
    if hasattr(geo, "ToBrep"):
        try:
            return geo.ToBrep()
        except:
            return None
    return None

def unique_x_values(points, tol):
    """Cluster points by X within tolerance and return sorted representative X values."""
    if tol <= 0: tol = 1e-6
    scale = 1.0 / tol
    buckets = {}
    # Ensure iterable
    seq = points if isinstance(points, (list, tuple)) else [points]
    for p in seq:
        if not isinstance(p, Point3d):
            continue
        key = int(round(p.X * scale))
        if key in buckets:
            buckets[key] = min(buckets[key], p.X)
        else:
            buckets[key] = p.X
    return sorted(buckets.values())

def yz_plane_at_x(x):
    """YZ plane translated to given X."""
    pl = Plane.WorldYZ
    pl.Origin = Point3d(x, 0.0, 0.0)
    return pl

# --- Main ------------------------------------------------------------------

Curves = []

if Surface is None or Points is None:
    pass
else:
    tol = get_model_tol()
    brep = to_brep(Surface)

    if brep is None:
        # Nothing to contour
        Curves = []
    else:
        xs = unique_x_values(Points, tol)
        for x in xs:
            pl = yz_plane_at_x(x)
            try:
                # This reliably returns IEnumerable[Curve]
                crvs = Brep.CreateContourCurves(brep, pl)
            except Exception:
                crvs = None

            if crvs:
                # Filter tiny/invalid results
                for c in crvs:
                    if c and c.IsValid and c.GetLength() > tol:
                        Curves.append(c)
# ---------- end py3 ----------
remap_5 = RemapNumbers(Source=bnd_6, Target=Domain(0, 1))  # -> Mapped, Clipped
cont_dist = Number(8)
pt_45 = Point(Point(0, 0, 0))
xz_5 = XZPlane(Origin=Point(0, 0, 0))
obj_tog_2 = Number(0)
graph_3 = GraphMapper(
    remap_5.Mapped,
    x0=0,
    x1=1,
    y0=0,
    y1=1,
    container_name="Bezier",
    cpx=[0, 0.25, 0.7203762531, 1],
    cpy=[0, 0.25, 0.5404884219, 1])
contour_from_points = ContourFromPoints()  # -> Curves; inputs Points: list of Point3d, Surface: Surface; same code as py3
contour = Contour(Shape=loft_2, Point=pt_45, Direction=xz_5, Distance=cont_dist)
onoff_3 = EnableDisableObject(Enabled=obj_tog_2, AllObjects_Object=ln_18)
dom_4 = ConstructDomain(DomainStart=att_top_b_z_min_3, DomainEnd=att_top_b_z_max_3)

louv_dim_a_2 = Number(4)
louv_dim_b_2 = Number(4)

bnd_7 = Bounds(Numbers=graph_3)
remap_6 = RemapNumbers(Value=graph_3, Source=bnd_7, Target=dom_4)  # -> Mapped, Clipped

fline_17 = FitLine(Points=pt_35)
eval_17 = EvaluateCurve(Curve=reparameterize(fline_17), Parameter=att_top_b_pt_3)  # -> Point, Tangent, Angle
point_attractor_17 = PointAttractor(A_2=eval_17.Point, B_2=flatten(pt_35), A=att_top_b_z_min_3, B=att_top_b_z_max_3)  # -> R, I, normalized
Z_15 = UnitZ(Factor=remap_6.Mapped)
move_29 = Move(Geometry=pt_35, Motion=Z_15)  # -> graft(Geometry), Transform

pt_46 = Point(flatten(move_29.Geometry))

fline_18 = FitLine(Points=pt_46)
eval_18 = EvaluateCurve(Curve=reparameterize(fline_18), Parameter=att_top_b_pt_3)  # -> Point, Tangent, Angle
point_attractor_18 = PointAttractor(A_2=eval_18.Point, B_2=flatten(pt_46), A=att_top_b_x_min_3, B=att_top_b_x_max_3)  # -> R, I, normalized
X_15 = UnitX(Factor=point_attractor_18.R)
move_30 = Move(Geometry=pt_46, Motion=X_15)  # -> graft(Geometry), Transform

offset_2 = OffsetCurve(Curve=contour, Distance=louv_dim_a_2, Corners=1)
simplify_5 = SimplifyTree(Tree=move_24.Geometry, Front=False)
simplify_6 = SimplifyTree(Tree=move_28.Geometry, Front=False)
simplify_7 = SimplifyTree(Tree=move_21.Geometry, Front=False)
simplify_8 = SimplifyTree(Tree=pt_40, Front=False)
simplify_9 = SimplifyTree(Tree=move_26.Geometry, Front=False)
simplify_10 = SimplifyTree(Tree=move_30.Geometry, Front=False)
simplify_11 = SimplifyTree(Tree=move_22.Geometry, Front=False)
simplify_12 = SimplifyTree(Tree=pt_41, Front=False)
edgesrf_2 = EdgeSurface(CurveA=contour, CurveB=offset_2)
Y_6 = UnitY(Factor=louv_dim_b_2)
extr_2 = Extrude(Base=edgesrf_2, Direction=Y_6)
obj_tog_3 = Number(0)
ln_10 = Line(StartPoint=simplify_8, EndPoint=simplify_7)
ln_11 = Line(StartPoint=simplify_6, EndPoint=simplify_5)
obj_tog_4 = Number(0)
ln_12 = Line(StartPoint=simplify_7, EndPoint=simplify_6)
ln_13 = Line(StartPoint=simplify_12, EndPoint=simplify_11)
ln_14 = Line(StartPoint=simplify_10, EndPoint=simplify_9)
ln_15 = Line(StartPoint=simplify_11, EndPoint=simplify_10)
onoff_4 = EnableDisableObject(Enabled=obj_tog_3, AllObjects_Object=[simplify_18, ln_18])
onoff_5 = EnableDisableObject(Enabled=obj_tog_4, AllObjects_Object=[simplify_18, ln_18])
merge_5 = Merge(Data1=ln_10, Data2=ln_12, Data3=ln_11)
merge_6 = Merge(Data1=ln_13, Data2=ln_15, Data3=ln_14)

louv_dim_a_3 = Number(4)
louv_dim_b_3 = Number(4)

louv_dim_a_4 = Number(4)
louv_dim_b_4 = Number(4)

join_4 = JoinCurves(Curves=merge_5, Preserve=False)
join_5 = JoinCurves(Curves=merge_6, Preserve=False)

louv_dim_a_5 = Number(4)
louv_dim_b_5 = Number(4)

louv_dim_a_6 = Number(4)
louv_dim_b_6 = Number(4)

# ---- group: BAKE ME!
geo_2 = Geometry(extr_2)

# ----
offset_3 = OffsetCurve(Curve=join_4, Distance=louv_dim_a_3, Corners=1)
offset_4 = OffsetCurve(Curve=join_5, Distance=louv_dim_a_4, Corners=1)
edgesrf_3 = EdgeSurface(CurveA=join_4, CurveB=offset_3)
edgesrf_4 = EdgeSurface(CurveA=join_5, CurveB=offset_4)
loft_3 = Loft(Curves=flatten(join_4), Options={Adjust=False, Closed=False, LoftEnds=0, LoftSimp=0, LoftType=0, Rebuild=10, Refit=0.01})
loft_4 = Loft(Curves=flatten(join_5), Options={Adjust=False, Closed=False, LoftEnds=0, LoftSimp=0, LoftType=0, Rebuild=10, Refit=0.01})
Y_7 = UnitY(Factor=louv_dim_b_3)
Y_8 = UnitY(Factor=louv_dim_b_4)
extr_3 = Extrude(Base=edgesrf_3, Direction=Y_7)
extr_4 = Extrude(Base=edgesrf_4, Direction=Y_8)

# ---- group: BAKE ME!
geo_3 = Geometry(extr_3)

geo_4 = Geometry(extr_4)

# ----
objbynn_2 = GetObjectByNickname()
objbynn_3 = GetObjectByNickname()
file_option_5 = Slider(3, range=1..12)
panel_19 = Panel("C:\Users\fharker\Documents\GitHub-Local\hub-alexandria\working-files\bus-hab\bus-hab-opt-a-")
concat_5 = Concatenate(FragmentA=panel_19, FragmentB=file_option_5, FragmentC=".csv")

hab_louv_dist_7 = Number(16)
hab_dep_7 = Number(240)
rect_h_7 = Number(96)
rec_w_7 = Number(72)

panel_20 = Panel("C:\Users\fharker\Documents\GitHub-Local\hub-alexandria\working-files\bus-hab\bus-hab-v3.csv")  # disabled
button_9 = Button()  # disabled

panel_21 = Panel("C:\Users\fharker\Documents\GitHub-Local\hub-alexandria\working-files\bus-hab\bus-hab-opt-GENERAL-bake.csv")  # disabled
button_10 = Button()  # disabled

panel_22 = Panel(concat_5)

pt_47 = Point(Point(0, 0, 0))
xz_6 = XZPlane(Origin=pt_47)
paramexporter_5 = Python3Script(Export=button_9, CSV_File=panel_20)  # inputs Export: Boolean; disabled; same code as paramexporter
geobaker_4 = Python3Script(Bake=button_10, CSV_File=panel_21)  # inputs Bake: Boolean, CSV_File: String; disabled; same code as geobaker
paramcontroller_5 = Python3Script(Update=Button(), CSV_File=panel_22)  # inputs Update: Boolean, CSV_File: String; same code as paramcontroller
rectangle_5 = Rectangle(Plane=xz_6, XSize=rec_w_7, YSize=rect_h_7, Radius=0)  # -> Rectangle, Length
division_5 = Division(A=hab_dep_7, B=hab_louv_dist_7)
Y_9 = UnitY(Factor=hab_louv_dist_7)
arrlinear_5 = LinearArray(Geometry=rectangle_5.Rectangle, Direction=Y_9, Count=division_5)  # -> Geometry, Transform
crv_5 = Curve(arrlinear_5.Geometry)
disc_6 = Discontinuity(Curve=crv_5, Level=1)  # -> Points, Parameters
item_8 = ListItem(List=disc_6.Points, Index=0, Wrap=True)  # -> Item, Item1, Item2, Item3
pt_48 = Point(item_8.Item3)
pt_49 = Point(item_8.Item2)
pt_50 = Point(item_8.Item)
pt_51 = Point(item_8.Item1)

pt_52 = Point(flatten(pt_51))

pt_53 = Point(flatten(pt_51))

att_bott_b_pt_6 = Number(1)
att_bott_b_x_min_6 = Number(-24)
att_bott_b_x_max_6 = Number(24)
att_bott_b_z_min_6 = Number(72)
att_bott_b_z_max_6 = Number(102)

att_top_b_z_min_6 = Number(24)
att_top_b_pt_6 = Number(1)
att_top_b_z_max_6 = Number(108)
att_top_b_x_min_6 = Number(-24)
att_top_b_x_max_6 = Number(12)

att_top_a_pt_6 = Number(1)
att_top_a_x_min_6 = Number(-32)
att_top_a_x_max_6 = Number(12)
att_top_a_z_min_6 = Number(-72)
att_top_a_z_max_6 = Number(18)

pt_54 = Point(flatten(pt_48))
fline_19 = FitLine(Points=pt_54)
eval_19 = EvaluateCurve(Curve=reparameterize(fline_19), Parameter=att_top_a_pt_6)  # -> Point, Tangent, Angle
point_attractor_19 = PointAttractor(A_2=eval_19.Point, B_2=flatten(pt_54), A=att_top_a_z_min_6, B=att_top_a_z_max_6)  # -> R, I, normalized
Z_16 = UnitZ(Factor=point_attractor_19.R)
move_31 = Move(Geometry=pt_54, Motion=Z_16)  # -> graft(Geometry), Transform

pt_55 = Point(flatten(move_31.Geometry))
pt_56 = Point(pt_50)

fline_20 = FitLine(Points=pt_55)
eval_20 = EvaluateCurve(Curve=reparameterize(fline_20), Parameter=att_top_a_pt_6)  # -> Point, Tangent, Angle
point_attractor_20 = PointAttractor(A_2=eval_20.Point, B_2=flatten(pt_55), A=att_top_a_x_min_6, B=att_top_a_x_max_6)  # -> R, I, normalized
X_16 = UnitX(Factor=point_attractor_20.R)
move_32 = Move(Geometry=pt_55, Motion=X_16)  # -> graft(Geometry), Transform

fline_21 = FitLine(Points=pt_52)
eval_21 = EvaluateCurve(Curve=reparameterize(fline_21), Parameter=att_bott_b_pt_6)  # -> Point, Tangent, Angle
point_attractor_21 = PointAttractor(A_2=eval_21.Point, B_2=flatten(pt_52), A=att_bott_b_z_min_6, B=att_bott_b_z_max_6)  # -> R, I, normalized
Z_17 = UnitZ(Factor=point_attractor_21.R)
move_33 = Move(Geometry=pt_52, Motion=Z_17)  # -> graft(Geometry), Transform

pt_57 = Point(flatten(move_33.Geometry))

fline_22 = FitLine(Points=pt_57)
eval_22 = EvaluateCurve(Curve=reparameterize(fline_22), Parameter=att_bott_b_pt_6)  # -> Point, Tangent, Angle
point_attractor_22 = PointAttractor(A_2=eval_22.Point, B_2=flatten(pt_57), A=att_bott_b_x_min_6, B=att_bott_b_x_max_6)  # -> R, I, normalized
X_17 = UnitX(Factor=point_attractor_22.R)
move_34 = Move(Geometry=pt_57, Motion=X_17)  # -> graft(Geometry), Transform

simplify_13 = SimplifyTree(Tree=move_34.Geometry, Front=False)
simplify_14 = SimplifyTree(Tree=move_32.Geometry, Front=False)
simplify_15 = SimplifyTree(Tree=pt_56, Front=False)
obj_tog_5 = Number(0)
ln_16 = Line(StartPoint=simplify_15, EndPoint=simplify_14)
onoff_6 = EnableDisableObject(Enabled=obj_tog_5, AllObjects_Object=[simplify_18, ln_18])

louv_dim_a_7 = Number(4)
louv_dim_b_7 = Number(4)

Y_10 = UnitY(Factor=louv_dim_b_7)
objbynn_4 = GetObjectByNickname()

hab_louv_dist_8 = Number(16)
hab_dep_8 = Number(240)
rect_h_8 = Number(96)
rec_w_8 = Number(72)

pt_58 = Point(Point(0, 0, 0))
xz_7 = XZPlane(Origin=pt_58)
rectangle_6 = Rectangle(Plane=xz_7, XSize=rec_w_8, YSize=rect_h_8, Radius=0)  # -> Rectangle, Length
division_6 = Division(A=hab_dep_8, B=hab_louv_dist_8)
Y_11 = UnitY(Factor=hab_louv_dist_8)
arrlinear_6 = LinearArray(Geometry=rectangle_6.Rectangle, Direction=Y_11, Count=division_6)  # -> Geometry, Transform
crv_6 = Curve(arrlinear_6.Geometry)
disc_7 = Discontinuity(Curve=crv_6, Level=1)  # -> Points, Parameters
item_9 = ListItem(List=disc_7.Points, Index=0, Wrap=True)  # -> Item, Item1, Item2, Item3
pt_59 = Point(item_9.Item3)
pt_60 = Point(item_9.Item2)
pt_61 = Point(item_9.Item)
pt_62 = Point(item_9.Item1)

file_option_6 = Slider(8, range=1..12)
panel_23 = Panel("C:\Users\fharker\Documents\GitHub-Local\hub-alexandria\working-files\bus-hab\bus-hab-opt-a-")
concat_6 = Concatenate(FragmentA=panel_23, FragmentB=file_option_6, FragmentC=".csv")
pt_63 = Point(Point(0, 0, 0))
xz_8 = XZPlane(Origin=pt_63)
paramexporter_6 = Python3Script(Export=button_7, CSV_File=panel_14)  # inputs Export: Boolean; disabled; same code as paramexporter
geobaker_5 = Python3Script(Bake=button_8, CSV_File=panel_15)  # inputs Bake: Boolean, CSV_File: String; disabled; same code as geobaker
rectangle_7 = Rectangle(Plane=xz_8, XSize=rec_w_4, YSize=rect_h_4, Radius=0)  # -> Rectangle, Length
division_7 = Division(A=hab_dep_4, B=hab_louv_dist_4)
Y_12 = UnitY(Factor=hab_louv_dist_4)
arrlinear_7 = LinearArray(Geometry=rectangle_7.Rectangle, Direction=Y_12, Count=division_7)  # -> Geometry, Transform
crv_7 = Curve(arrlinear_7.Geometry)
disc_8 = Discontinuity(Curve=crv_7, Level=1)  # -> Points, Parameters
item_10 = ListItem(List=disc_8.Points, Index=0, Wrap=True)  # -> Item, Item1, Item2, Item3
pt_64 = Point(item_10.Item3)
pt_65 = Point(item_10.Item2)
pt_66 = Point(item_10.Item)
pt_67 = Point(item_10.Item1)
pt_68 = Point(pt_66)
simplify_16 = SimplifyTree(Tree=pt_68, Front=False)
obj_tog_6 = Number(0)
onoff_7 = EnableDisableObject(Enabled=obj_tog_6, AllObjects_Object=[simplify_18, ln_18])
Y_13 = UnitY(Factor=louv_dim_b_5)

panel_24 = Panel(concat_6)

pt_69 = Point(flatten(pt_67))

pt_70 = Point(flatten(pt_67))

pt_71 = Point(flatten(pt_64))
fline_23 = FitLine(Points=pt_71)
eval_23 = EvaluateCurve(Curve=reparameterize(fline_23), Parameter=att_top_a_pt_4)  # -> Point, Tangent, Angle
point_attractor_23 = PointAttractor(A_2=eval_23.Point, B_2=flatten(pt_71), A=att_top_a_z_min_4, B=att_top_a_z_max_4)  # -> R, I, normalized
Z_18 = UnitZ(Factor=point_attractor_23.R)
move_35 = Move(Geometry=pt_71, Motion=Z_18)  # -> graft(Geometry), Transform

fline_24 = FitLine(Points=pt_69)
eval_24 = EvaluateCurve(Curve=reparameterize(fline_24), Parameter=att_bott_b_pt_4)  # -> Point, Tangent, Angle
point_attractor_24 = PointAttractor(A_2=eval_24.Point, B_2=flatten(pt_69), A=att_bott_b_z_min_4, B=att_bott_b_z_max_4)  # -> R, I, normalized
Z_19 = UnitZ(Factor=point_attractor_24.R)
move_36 = Move(Geometry=pt_69, Motion=Z_19)  # -> graft(Geometry), Transform

fline_25 = FitLine(Points=pt_70)
eval_25 = EvaluateCurve(Curve=reparameterize(fline_25), Parameter=att_top_b_pt_4)  # -> Point, Tangent, Angle
point_attractor_25 = PointAttractor(A_2=eval_25.Point, B_2=flatten(pt_70), A=att_top_b_z_min_4, B=att_top_b_z_max_4)  # -> R, I, normalized
Z_20 = UnitZ(Factor=point_attractor_25.R)
move_37 = Move(Geometry=pt_70, Motion=Z_20)  # -> graft(Geometry), Transform

file_option_7 = Slider(1, range=1..12)
panel_25 = Panel("C:\Users\fharker\Documents\GitHub-Local\hub-alexandria\working-files\bus-hab\bus-hab-opt-c-")
concat_7 = Concatenate(FragmentA=panel_25, FragmentB=file_option_7, FragmentC=".csv")
pt_72 = Point(Point(0, 0, 0))
xz_9 = XZPlane(Origin=pt_72)
paramexporter_7 = Python3Script(Export=Button(), CSV_File=panel_16)  # inputs Export: Boolean; same code as paramexporter
geobaker_6 = Python3Script()  # inputs Bake: Boolean, CSV_File: String; same code as paramcontroller
rectangle_8 = Rectangle(Plane=xz_9, XSize=rec_w_5, YSize=rect_h_5, Radius=0)  # -> Rectangle, Length
division_8 = Division(A=hab_dep_5, B=hab_louv_dist_5)
Y_14 = UnitY(Factor=hab_louv_dist_5)
arrlinear_8 = LinearArray(Geometry=rectangle_8.Rectangle, Direction=Y_14, Count=division_8)  # -> Geometry, Transform
crv_8 = Curve(arrlinear_8.Geometry)
disc_9 = Discontinuity(Curve=crv_8, Level=1)  # -> Points, Parameters
item_11 = ListItem(List=disc_9.Points, Index=0, Wrap=True)  # -> Item, Item1, Item2, Item3
pt_73 = Point(item_11.Item3)
pt_74 = Point(item_11.Item2)
pt_75 = Point(item_11.Item)
pt_76 = Point(item_11.Item1)
pt_77 = Point(pt_75)
simplify_17 = SimplifyTree(Tree=pt_77, Front=False)
obj_tog_7 = Number(0)
onoff_8 = EnableDisableObject(Enabled=obj_tog_7, AllObjects_Object=ln_21)
Y_15 = UnitY(Factor=louv_dim_b_6)

panel_26 = Panel(concat_7)

pt_78 = Point(flatten(pt_76))

pt_79 = Point(flatten(pt_76))

pt_80 = Point(flatten(pt_73))
fline_26 = FitLine(Points=pt_80)
eval_26 = EvaluateCurve(Curve=reparameterize(fline_26), Parameter=att_top_a_pt_5)  # -> Point, Tangent, Angle
point_attractor_26 = PointAttractor(A_2=eval_26.Point, B_2=flatten(pt_80), A=att_top_a_z_min_5, B=att_top_a_z_max_5)  # -> R, I, normalized
Z_21 = UnitZ(Factor=point_attractor_26.R)
move_38 = Move(Geometry=pt_80, Motion=Z_21)  # -> graft(Geometry), Transform

fline_27 = FitLine(Points=pt_78)
eval_27 = EvaluateCurve(Curve=reparameterize(fline_27), Parameter=att_bott_b_pt_5)  # -> Point, Tangent, Angle
point_attractor_27 = PointAttractor(A_2=eval_27.Point, B_2=flatten(pt_78), A=att_bott_b_z_min_5, B=att_bott_b_z_max_5)  # -> R, I, normalized
Z_22 = UnitZ(Factor=point_attractor_27.R)
move_39 = Move(Geometry=pt_78, Motion=Z_22)  # -> graft(Geometry), Transform

fline_28 = FitLine(Points=pt_79)
eval_28 = EvaluateCurve(Curve=reparameterize(fline_28), Parameter=att_top_b_pt_5)  # -> Point, Tangent, Angle
point_attractor_28 = PointAttractor(A_2=eval_28.Point, B_2=flatten(pt_79), A=att_top_b_z_min_5, B=att_top_b_z_max_5)  # -> R, I, normalized
Z_23 = UnitZ(Factor=point_attractor_28.R)
move_40 = Move(Geometry=pt_79, Motion=Z_23)  # -> graft(Geometry), Transform

paramcontroller_6 = Python3Script(Update=Button(), CSV_File=panel_24)  # inputs Update: Boolean, CSV_File: String; same code as paramcontroller
pt_81 = Point(flatten(move_35.Geometry))
pt_82 = Point(flatten(move_36.Geometry))
pt_83 = Point(flatten(move_37.Geometry))

fline_29 = FitLine(Points=pt_81)
eval_29 = EvaluateCurve(Curve=reparameterize(fline_29), Parameter=att_top_a_pt_4)  # -> Point, Tangent, Angle
point_attractor_29 = PointAttractor(A_2=eval_29.Point, B_2=flatten(pt_81), A=att_top_a_x_min_4, B=att_top_a_x_max_4)  # -> R, I, normalized
X_18 = UnitX(Factor=point_attractor_29.R)
move_41 = Move(Geometry=pt_81, Motion=X_18)  # -> graft(Geometry), Transform

fline_30 = FitLine(Points=pt_82)
eval_30 = EvaluateCurve(Curve=reparameterize(fline_30), Parameter=att_bott_b_pt_4)  # -> Point, Tangent, Angle
point_attractor_30 = PointAttractor(A_2=eval_30.Point, B_2=flatten(pt_82), A=att_bott_b_x_min_4, B=att_bott_b_x_max_4)  # -> R, I, normalized
X_19 = UnitX(Factor=point_attractor_30.R)
move_42 = Move(Geometry=pt_82, Motion=X_19)  # -> graft(Geometry), Transform

fline_31 = FitLine(Points=pt_83)
eval_31 = EvaluateCurve(Curve=reparameterize(fline_31), Parameter=att_top_b_pt_4)  # -> Point, Tangent, Angle
point_attractor_31 = PointAttractor(A_2=eval_31.Point, B_2=flatten(pt_83), A=att_top_b_x_min_4, B=att_top_b_x_max_4)  # -> R, I, normalized
X_20 = UnitX(Factor=point_attractor_31.R)
move_43 = Move(Geometry=pt_83, Motion=X_20)  # -> graft(Geometry), Transform

simplify_18 = SimplifyTree(Tree=move_42.Geometry, Front=False)  # disabled
simplify_19 = SimplifyTree(Tree=move_43.Geometry, Front=False)
simplify_20 = SimplifyTree(Tree=move_41.Geometry, Front=False)
ln_17 = Line(StartPoint=simplify_16, EndPoint=simplify_20)
ln_18 = Line(StartPoint=simplify_19, EndPoint=simplify_18)  # disabled
ln_19 = Line(StartPoint=simplify_20, EndPoint=simplify_19)
merge_7 = Merge(Data1=ln_17, Data2=ln_19, Data3=ln_18)
join_6 = JoinCurves(Curves=merge_7, Preserve=False)
offset_5 = OffsetCurve(Curve=join_6, Distance=louv_dim_a_5, Corners=1)
edgesrf_5 = EdgeSurface(CurveA=join_6, CurveB=offset_5)
loft_5 = Loft(Curves=flatten(join_6), Options={Adjust=False, Closed=False, LoftEnds=0, LoftSimp=0, LoftType=0, Rebuild=10, Refit=0.01})
extr_5 = Extrude(Base=edgesrf_5, Direction=Y_13)

# ---- group: BAKE ME!
geo_5 = Geometry(extr_5)

# ----
paramcontroller_7 = Python3Script(Update=Button(), CSV_File=panel_26)  # inputs Update: Boolean, CSV_File: String; same code as paramcontroller
pt_84 = Point(flatten(move_38.Geometry))
pt_85 = Point(flatten(move_39.Geometry))
pt_86 = Point(flatten(move_40.Geometry))

fline_32 = FitLine(Points=pt_84)
eval_32 = EvaluateCurve(Curve=reparameterize(fline_32), Parameter=att_top_a_pt_5)  # -> Point, Tangent, Angle
point_attractor_32 = PointAttractor(A_2=eval_32.Point, B_2=flatten(pt_84), A=att_top_a_x_min_5, B=att_top_a_x_max_5)  # -> R, I, normalized
X_21 = UnitX(Factor=point_attractor_32.R)
move_44 = Move(Geometry=pt_84, Motion=X_21)  # -> graft(Geometry), Transform

fline_33 = FitLine(Points=pt_85)
eval_33 = EvaluateCurve(Curve=reparameterize(fline_33), Parameter=att_bott_b_pt_5)  # -> Point, Tangent, Angle
point_attractor_33 = PointAttractor(A_2=eval_33.Point, B_2=flatten(pt_85), A=att_bott_b_x_min_5, B=att_bott_b_x_max_5)  # -> R, I, normalized
X_22 = UnitX(Factor=point_attractor_33.R)
move_45 = Move(Geometry=pt_85, Motion=X_22)  # -> graft(Geometry), Transform

fline_34 = FitLine(Points=pt_86)
eval_34 = EvaluateCurve(Curve=reparameterize(fline_34), Parameter=att_top_b_pt_5)  # -> Point, Tangent, Angle
point_attractor_34 = PointAttractor(A_2=eval_34.Point, B_2=flatten(pt_86), A=att_top_b_x_min_5, B=att_top_b_x_max_5)  # -> R, I, normalized
X_23 = UnitX(Factor=point_attractor_34.R)
move_46 = Move(Geometry=pt_86, Motion=X_23)  # -> graft(Geometry), Transform

simplify_21 = SimplifyTree(Tree=move_45.Geometry, Front=False)
simplify_22 = SimplifyTree(Tree=move_46.Geometry, Front=False)
simplify_23 = SimplifyTree(Tree=move_44.Geometry, Front=False)
ln_20 = Line(StartPoint=simplify_17, EndPoint=simplify_23)
ln_21 = Line(StartPoint=simplify_22, EndPoint=simplify_21)  # disabled
ln_22 = Line(StartPoint=simplify_23, EndPoint=simplify_22)
merge_8 = Merge(Data1=ln_20, Data2=ln_22, Data3=ln_21)
join_7 = JoinCurves(Curves=merge_8, Preserve=False)
offset_6 = OffsetCurve(Curve=join_7, Distance=louv_dim_a_6, Corners=1)
edgesrf_6 = EdgeSurface(CurveA=join_7, CurveB=offset_6)
loft_6 = Loft(Curves=flatten(join_7), Options={Adjust=False, Closed=False, LoftEnds=0, LoftSimp=0, LoftType=0, Rebuild=10, Refit=0.01})
extr_6 = Extrude(Base=edgesrf_6, Direction=Y_15)

# ---- group: BAKE ME!
geo_6 = Geometry(extr_6)

# ----
fline_35 = FitLine(Points=pt_53)
eval_35 = EvaluateCurve(Curve=reparameterize(fline_35), Parameter=att_top_b_pt_6)  # -> Point, Tangent, Angle
point_attractor_35 = PointAttractor(A_2=eval_35.Point, B_2=flatten(pt_53), A=att_top_b_z_min_6, B=att_top_b_z_max_6)  # -> R, I, normalized

graph_4 = GraphMapper(point_attractor_35.normalized, x0=0, x1=1, y0=0, y1=1, Cx=0.09071594477, Cy=0.7153081894, container_name="Conic")
bnd_8 = Bounds(Numbers=graph_4)
remap_7 = RemapNumbers(Value=graph_4, Source=bnd_8, Target=point_attractor_35.I)  # -> Mapped, Clipped

Z_24 = UnitZ(Factor=remap_7.Mapped)
move_47 = Move(Geometry=pt_53, Motion=Z_24)  # -> graft(Geometry), Transform

pt_87 = Point(flatten(move_47.Geometry))

fline_36 = FitLine(Points=pt_87)
eval_36 = EvaluateCurve(Curve=reparameterize(fline_36), Parameter=att_top_b_pt_6)  # -> Point, Tangent, Angle
point_attractor_36 = PointAttractor(A_2=eval_36.Point, B_2=flatten(pt_87), A=att_top_b_x_min_6, B=att_top_b_x_max_6)  # -> R, I, normalized

graph_5 = GraphMapper(point_attractor_36.R, x0=0, x1=1, y0=0, y1=1, Cx=0.7759199142, Cy=0.3601361513, container_name="Conic")
bnd_9 = Bounds(Numbers=graph_5)
remap_8 = RemapNumbers(Value=graph_5, Source=bnd_9, Target=point_attractor_36.I)  # -> Mapped, Clipped

X_24 = UnitX(Factor=remap_8.Mapped)
move_48 = Move(Geometry=pt_87, Motion=X_24)  # -> graft(Geometry), Transform

simplify_24 = SimplifyTree(Tree=move_48.Geometry, Front=False)
ln_23 = Line(StartPoint=simplify_24, EndPoint=simplify_13)
ln_24 = Line(StartPoint=simplify_14, EndPoint=simplify_24)
merge_9 = Merge(Data1=ln_16, Data2=ln_24, Data3=ln_23)
join_8 = JoinCurves(Curves=merge_9, Preserve=False)
offset_7 = OffsetCurve(Curve=join_8, Distance=louv_dim_a_7, Corners=1)
edgesrf_7 = EdgeSurface(CurveA=join_8, CurveB=offset_7)
loft_7 = Loft(Curves=flatten(join_8), Options={Adjust=False, Closed=False, LoftEnds=0, LoftSimp=0, LoftType=0, Rebuild=10, Refit=0.01})
extr_7 = Extrude(Base=edgesrf_7, Direction=Y_10)

# ---- group: BAKE ME!
geo_7 = Geometry(extr_7)

# ==== cluster PointAttractor: Utility
A = ClusterInput()
x = ClusterInput()
A_2 = ClusterInput()
B = ClusterInput()
B_2 = ClusterInput()
dist = Distance(PointA=A_2, PointB=B_2)
dom = ConstructDomain(DomainStart=A, DomainEnd=B)
bnd = Bounds(Numbers=dist)
remap = RemapNumbers(Value=dist, Source=bnd, Target=dom)  # -> Mapped, Clipped
bnd_2 = Bounds(Numbers=remap.Mapped)
remap_2 = RemapNumbers(Value=remap.Mapped, Source=bnd_2, Target=Domain(0, 1))  # -> Normalized, Clipped
R = ClusterOutput(remap.Mapped)
I = ClusterOutput(dom)
normalized = ClusterOutput(remap_2.Normalized)
