# Grasshopper definition bus-hab-opt-GENERAL_v2.gh (Grasshopper 1.0.8)

pt = Point(Point(0, 0, 0))
pt_2 = Point(Point(0, 0, 0))
pt_3 = Point(Point(0, 0, 0))
vec = VectorXYZ(XComponent=0, YComponent=Slider(300, range=0..1000), ZComponent=0)  # -> Vector, Length
vec_2 = VectorXYZ(XComponent=0, YComponent=Slider(60, range=0..1000), ZComponent=0)  # -> Vector, Length
vec_3 = VectorXYZ(XComponent=0, YComponent=Slider(72, range=0..1000), ZComponent=0)  # -> Vector, Length
move = Move(Geometry=pt, Motion=vec.Vector)  # -> Geometry, Transform
move_2 = Move(Geometry=pt_2, Motion=vec_2.Vector)  # -> Geometry, Transform
move_3 = Move(Geometry=pt_3, Motion=vec_3.Vector)  # -> Geometry, Transform
pt_4 = Point(Point(0, 0, 0))
pt_5 = Point(move.Geometry)
pt_6 = Point(move_2.Geometry)
pt_7 = Point(move_3.Geometry)
neg = Negative(Value=Slider(48, range=0..1000))
neg_2 = Negative(Value=Slider(18, range=0..1000))
neg_3 = Negative(Value=Slider(12, range=0..1000))
neg_4 = Negative(Value=Slider(12, range=0..1000))
vec_4 = VectorXYZ(XComponent=neg, YComponent=0, ZComponent=Slider(120, range=0..1000))  # -> Vector, Length
vec_5 = VectorXYZ(XComponent=neg_2, YComponent=0, ZComponent=Slider(12, range=0..1000))  # -> Vector, Length
vec_6 = VectorXYZ(XComponent=neg_3, YComponent=0, ZComponent=Slider(100, range=0..1000))  # -> Vector, Length
vec_7 = VectorXYZ(XComponent=neg_4, YComponent=0, ZComponent=Slider(90, range=0..1000))  # -> Vector, Length
move_4 = Move(Geometry=pt_4, Motion=vec_4.Vector)  # -> Geometry, Transform
move_5 = Move(Geometry=pt_5, Motion=vec_5.Vector)  # -> Geometry, Transform
move_6 = Move(Geometry=pt_6, Motion=vec_6.Vector)  # -> Geometry, Transform
move_7 = Move(Geometry=pt_7, Motion=vec_7.Vector)  # -> Geometry, Transform
pt_8 = Point(move_4.Geometry)
pt_9 = Point(move_5.Geometry)
pt_10 = Point(move_6.Geometry)
pt_11 = Point(move_7.Geometry)
vec_8 = VectorXYZ(XComponent=Slider(60, range=0..1000), YComponent=0, ZComponent=Slider(24, range=0..100))  # -> Vector, Length
vec_9 = VectorXYZ(XComponent=Slider(42, range=0..1000), YComponent=0, ZComponent=Slider(12, range=0..100))  # -> Vector, Length
vec_10 = VectorXYZ(XComponent=Slider(36, range=0..1000), YComponent=0, ZComponent=Slider(12, range=0..100))  # -> Vector, Length
vec_11 = VectorXYZ(XComponent=Slider(36, range=0..1000), YComponent=0, ZComponent=Slider(12, range=0..100))  # -> Vector, Length
move_8 = Move(Geometry=pt_8, Motion=vec_8.Vector)  # -> Geometry, Transform
move_9 = Move(Geometry=pt_9, Motion=vec_9.Vector)  # -> Geometry, Transform
move_10 = Move(Geometry=pt_10, Motion=vec_10.Vector)  # -> Geometry, Transform
move_11 = Move(Geometry=pt_11, Motion=vec_11.Vector)  # -> Geometry, Transform
pt_12 = Point(move_8.Geometry)
pt_13 = Point(move_9.Geometry)
pt_14 = Point(move_10.Geometry)
pt_15 = Point(move_11.Geometry)
neg_5 = Negative(Value=Slider(12, range=0..100))
neg_6 = Negative(Value=Slider(36, range=0..100))
neg_7 = Negative(Value=Slider(6, range=0..100))
neg_8 = Negative(Value=Slider(6, range=0..100))
vec_12 = VectorXYZ(XComponent=Slider(24, range=0..100), YComponent=0, ZComponent=neg_5)  # -> Vector, Length
vec_13 = VectorXYZ(XComponent=Slider(4, range=0..100), YComponent=0, ZComponent=neg_6)  # -> Vector, Length
vec_14 = VectorXYZ(XComponent=Slider(24, range=0..100), YComponent=0, ZComponent=neg_7)  # -> Vector, Length
vec_15 = VectorXYZ(XComponent=Slider(24, range=0..100), YComponent=0, ZComponent=neg_8)  # -> Vector, Length
move_12 = Move(Geometry=pt_12, Motion=vec_12.Vector)  # -> Geometry, Transform
move_13 = Move(Geometry=pt_13, Motion=vec_13.Vector)  # -> Geometry, Transform
move_14 = Move(Geometry=pt_14, Motion=vec_14.Vector)  # -> Geometry, Transform
move_15 = Move(Geometry=pt_15, Motion=vec_15.Vector)  # -> Geometry, Transform
pt_16 = Point(move_12.Geometry)
pt_17 = Point(move_13.Geometry)
pt_18 = Point(move_14.Geometry)
pt_19 = Point(move_15.Geometry)
merge = Merge(Data1=pt_4, Data2=pt_8, Data3=pt_12, Data4=pt_16)
merge_2 = Merge(Data1=pt_5, Data2=pt_9, Data3=pt_13, Data4=pt_17)
merge_3 = Merge(Data1=pt_6, Data2=pt_10, Data3=pt_14, Data4=pt_18)
merge_4 = Merge(Data1=pt_7, Data2=pt_11, Data3=pt_15, Data4=pt_19)
pline = PolyLine(Vertices=merge, Closed=False)
pline_2 = PolyLine(Vertices=merge_2, Closed=False)
pline_3 = PolyLine(Vertices=merge_3, Closed=False)
pline_4 = PolyLine(Vertices=merge_4, Closed=False)
crv = Curve(pline_4)
crv_2 = Curve(pline)
crv_3 = Curve(pline_2)
crv_4 = Curve(pline_3)
merge_5 = Merge(Data1=crv_2, Data2=crv_4, Data3=crv, Data4=crv_3)
loft = Loft(Curves=merge_5, Options={Adjust=False, Closed=False, LoftEnds=0, LoftSimp=0, LoftType=0, Rebuild=10, Refit=0.01})
geo = Geometry(loft)
xz = XZPlane(Origin=Point(0, 0, 0))
Y = UnitY(Factor=1)
contour = Contour(Shape=geo, Point=xz, Direction=Y, Distance=Slider(8, range=0..100))  # -> flatten(Contours)
merge_6 = Merge(Data1=merge_5, Data2=contour)  # -> flatten(Result)
offset = OffsetCurve(Curve=contour, Distance=Slider(2, range=0..10), Corners=1)  # -> flatten(Curve)
edgesrf = EdgeSurface(CurveA=contour, CurveB=offset)
Y_2 = UnitY(Factor=Slider(4, range=0..10))
extr = Extrude(Base=edgesrf, Direction=Y_2)
geo_2 = Geometry([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])
geo_3 = Geometry([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])
geo_4 = Geometry(Tree({0;0;0}: [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], {0;1;0}: [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], {0;2;0}: [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], {0;3;0}: [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], {0;4;0}: [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], {0;5;0}: [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]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))
geo_5 = Geometry([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])
geo_6 = Geometry([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])
geo_7 = Geometry(extr)
geo_8 = Geometry(geo_7)
geo_9 = Geometry(<brep referenced from the Rhino model>)
sdiff = SolidDifference(BrepsA=flatten(geo_8), BrepsB=geo_9)
geo_10 = Geometry(sdiff)

pt_20 = Point(Point(0, 0, 0))
pt_21 = Point(Point(0, 0, 0))
pt_22 = Point(Point(0, 0, 0))
vec_16 = VectorXYZ(XComponent=0, YComponent=Slider(360, range=0..1000), ZComponent=0)  # -> Vector, Length
vec_17 = VectorXYZ(XComponent=0, YComponent=Slider(120, range=0..1000), ZComponent=0)  # -> Vector, Length
vec_18 = VectorXYZ(XComponent=0, YComponent=Slider(132, range=0..1000), ZComponent=0)  # -> Vector, Length
move_16 = Move(Geometry=pt_20, Motion=vec_16.Vector)  # -> Geometry, Transform
move_17 = Move(Geometry=pt_21, Motion=vec_17.Vector)  # -> Geometry, Transform
move_18 = Move(Geometry=pt_22, Motion=vec_18.Vector)  # -> Geometry, Transform
pt_23 = Point(Point(0, 0, 0))
pt_24 = Point(move_16.Geometry)
pt_25 = Point(move_17.Geometry)
pt_26 = Point(move_18.Geometry)
neg_9 = Negative(Value=Slider(48, range=0..1000))
neg_10 = Negative(Value=Slider(18, range=0..1000))
neg_11 = Negative(Value=Slider(12, range=0..1000))
neg_12 = Negative(Value=Slider(12, range=0..1000))
vec_19 = VectorXYZ(XComponent=neg_9, YComponent=0, ZComponent=Slider(120, range=0..1000))  # -> Vector, Length
vec_20 = VectorXYZ(XComponent=neg_10, YComponent=0, ZComponent=Slider(12, range=0..1000))  # -> Vector, Length
vec_21 = VectorXYZ(XComponent=neg_11, YComponent=0, ZComponent=Slider(100, range=0..1000))  # -> Vector, Length
vec_22 = VectorXYZ(XComponent=neg_12, YComponent=0, ZComponent=Slider(90, range=0..1000))  # -> Vector, Length
move_19 = Move(Geometry=pt_23, Motion=vec_19.Vector)  # -> Geometry, Transform
move_20 = Move(Geometry=pt_24, Motion=vec_20.Vector)  # -> Geometry, Transform
move_21 = Move(Geometry=pt_25, Motion=vec_21.Vector)  # -> Geometry, Transform
move_22 = Move(Geometry=pt_26, Motion=vec_22.Vector)  # -> Geometry, Transform
pt_27 = Point(move_19.Geometry)
pt_28 = Point(move_20.Geometry)
pt_29 = Point(move_21.Geometry)
pt_30 = Point(move_22.Geometry)
vec_23 = VectorXYZ(XComponent=Slider(60, range=0..1000), YComponent=0, ZComponent=Slider(24, range=0..100))  # -> Vector, Length
vec_24 = VectorXYZ(XComponent=Slider(42, range=0..1000), YComponent=0, ZComponent=Slider(12, range=0..100))  # -> Vector, Length
vec_25 = VectorXYZ(XComponent=Slider(36, range=0..1000), YComponent=0, ZComponent=Slider(12, range=0..100))  # -> Vector, Length
vec_26 = VectorXYZ(XComponent=Slider(36, range=0..1000), YComponent=0, ZComponent=Slider(12, range=0..100))  # -> Vector, Length
move_23 = Move(Geometry=pt_27, Motion=vec_23.Vector)  # -> Geometry, Transform
move_24 = Move(Geometry=pt_28, Motion=vec_24.Vector)  # -> Geometry, Transform
move_25 = Move(Geometry=pt_29, Motion=vec_25.Vector)  # -> Geometry, Transform
move_26 = Move(Geometry=pt_30, Motion=vec_26.Vector)  # -> Geometry, Transform
pt_31 = Point(move_23.Geometry)
pt_32 = Point(move_24.Geometry)
pt_33 = Point(move_25.Geometry)
pt_34 = Point(move_26.Geometry)
neg_13 = Negative(Value=Slider(12, range=0..100))
neg_14 = Negative(Value=Slider(36, range=0..100))
neg_15 = Negative(Value=Slider(6, range=0..100))
neg_16 = Negative(Value=Slider(6, range=0..100))
vec_27 = VectorXYZ(XComponent=Slider(24, range=0..100), YComponent=0, ZComponent=neg_13)  # -> Vector, Length
vec_28 = VectorXYZ(XComponent=Slider(4, range=0..100), YComponent=0, ZComponent=neg_14)  # -> Vector, Length
vec_29 = VectorXYZ(XComponent=Slider(24, range=0..100), YComponent=0, ZComponent=neg_15)  # -> Vector, Length
vec_30 = VectorXYZ(XComponent=Slider(24, range=0..100), YComponent=0, ZComponent=neg_16)  # -> Vector, Length
move_27 = Move(Geometry=pt_31, Motion=vec_27.Vector)  # -> Geometry, Transform
move_28 = Move(Geometry=pt_32, Motion=vec_28.Vector)  # -> Geometry, Transform
move_29 = Move(Geometry=pt_33, Motion=vec_29.Vector)  # -> Geometry, Transform
move_30 = Move(Geometry=pt_34, Motion=vec_30.Vector)  # -> Geometry, Transform
pt_35 = Point(move_27.Geometry)
pt_36 = Point(move_28.Geometry)
pt_37 = Point(move_29.Geometry)
pt_38 = Point(move_30.Geometry)
merge_7 = Merge(Data1=pt_23, Data2=pt_27, Data3=pt_31, Data4=pt_35)
merge_8 = Merge(Data1=pt_24, Data2=pt_28, Data3=pt_32, Data4=pt_36)
merge_9 = Merge(Data1=pt_25, Data2=pt_29, Data3=pt_33, Data4=pt_37)
merge_10 = Merge(Data1=pt_26, Data2=pt_30, Data3=pt_34, Data4=pt_38)
pline_5 = PolyLine(Vertices=merge_7, Closed=False)
pline_6 = PolyLine(Vertices=merge_8, Closed=False)
pline_7 = PolyLine(Vertices=merge_9, Closed=False)
pline_8 = PolyLine(Vertices=merge_10, Closed=False)
crv_5 = Curve(pline_8)
crv_6 = Curve(pline_5)
crv_7 = Curve(pline_6)
crv_8 = Curve(pline_7)
merge_11 = Merge(Data1=crv_6, Data2=crv_8, Data3=crv_5, Data4=crv_7)
loft_2 = Loft(Curves=merge_11, Options={Adjust=False, Closed=False, LoftEnds=0, LoftSimp=0, LoftType=0, Rebuild=10, Refit=0.01})
geo_11 = Geometry(loft_2)
xz_2 = XZPlane(Origin=Point(0, 0, 0))
Y_3 = UnitY(Factor=1)
contour_2 = Contour(Shape=geo_11, Point=xz_2, Direction=Y_3, Distance=Slider(8, range=0..100))  # -> flatten(Contours)
merge_12 = Merge(Data1=merge_11, Data2=contour_2)  # -> flatten(Result)
offset_2 = OffsetCurve(Curve=contour_2, Distance=Slider(2, range=0..10), Corners=1)  # -> flatten(Curve)
edgesrf_2 = EdgeSurface(CurveA=contour_2, CurveB=offset_2)
Y_4 = UnitY(Factor=Slider(4, range=0..10))
extr_2 = Extrude(Base=edgesrf_2, Direction=Y_4)
geo_12 = Geometry([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])
geo_13 = Geometry([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])
geo_14 = Geometry(Tree({0;0;0}: [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], {0;1;0}: [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], {0;2;0}: [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], {0;3;0}: [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], {0;4;0}: [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], {0;5;0}: [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]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))
geo_15 = Geometry([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])
geo_16 = Geometry([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])
geo_17 = Geometry(extr_2)
geo_18 = Geometry(geo_17)
geo_19 = Geometry(<brep referenced from the Rhino model>)
sdiff_2 = SolidDifference(BrepsA=flatten(geo_18), BrepsB=geo_19)
geo_20 = Geometry(sdiff_2)
